# Grasshopper definition metrics.gh (Grasshopper 1.0.7)
# plug-ins: ScriptParasite, Kangaroo2 Components, Shortest Walk in Gh, EleFront

number_of_beds_per_patient_room = Number(2)
number_slider = Slider(2, range=0.1..2)

# ---- group: Yale Traffic Index: Probabilities of Choosing a Path
p_patient_room_patient_room = Number(19.1)
p_nurse_station_patient_room = Number(16.7)
p_utility_room_patient_room = Number(14.1)
p_nurse_station_utility_room = Number(9.8)
p_nurse_station_elevator = Number(6.1)
p_nurse_station_medical_clinic = Number(5.8)
p_patient_room_pantry = Number(4.6)
p_patient_room_elevator = Number(3.7)
p_medication_room_patient_room = Number(4.8)
p_utility_room_elevator_lobby = Number(2.5)
p_utility_room_medical_clinic = Number(2.8)
p_utility_room_pantry = Number(0.7)
p_utility_room_janitor_closet = Number(1.1)
p_nurse_station_pantry = Number(1)

# ---- group: Script Hyperparameters
resolution = Slider(0.1, range=0.001..1000)
number_slider_2 = Slider(20, range=2..30)
number_slider_3 = Slider(0.05, range=0..2)
number_slider_4 = Slider(45, range=0..180)
number_slider_5 = Slider(150, range=0..180)

# ----
visualize_labels = BooleanToggle(True)

# ---- group: Toggle Visualizations
visualize_medial_axis = BooleanToggle(False)
visualize_partitioning = BooleanToggle(False)
visualize_nodes = BooleanToggle(False)

# ---- group: Script Editor Synchronization
toggle = BooleanToggle(True)
panel = Panel("C:\Users\rapha\Documents\ebdwebsite.github.io\toolkit\scripts")

# ---- group: Room Labels
patient_room = Point([<point referenced from the Rhino model> x31])
nurse_station = Point([<point referenced from the Rhino model> x2])
utility_room = Point(<point referenced from the Rhino model>)
elevator = Point([<point referenced from the Rhino model> x2])
elevator_lobby = Point(<point referenced from the Rhino model>)
medical_clinic = Point(<point referenced from the Rhino model>)
pantry = Point([<point referenced from the Rhino model> x2])
medication_room = Point([<point referenced from the Rhino model> x2])
janitor_closet = Point([<point referenced from the Rhino model> x2])

# ---- group: Floorplan Boundaries
layout_curves = Curve([<curve referenced from the Rhino model> x67])

# ----
toggle_2 = BooleanToggle(True)
edges = Curve([<curve referenced from the Rhino model> x44])
material = CreateMaterial(
    Diffuse=ColourSwatch(SwatchColor=RGB(212, 212, 212)),
    Specular=RGB(255, 255, 255),
    Emission=RGB(0, 0, 0),
    Transparency=0,
    Shine=0)

# ---- group: Labelling
python = GhPythonScript()  # -> out, list
# ---------- python: Python ----------
__author__ = "rapha"
__version__ = "2021.10.07"

import rhinoscriptsyntax as rs

list = []
for i in range(9):
    list.append(1.0/8 * i)
# ---------- end python ----------
gradient = Gradient(
    LowerLimit=0,
    UpperLimit=1,
    Parameter=python.list,
    stops=[0: RGB(67, 12, 156), 0.5: RGB(214, 51, 89), 1: RGB(251, 255, 0)])
col = Colour(gradient)
panel_2 = Panel("""Patient
Room""")
panel_3 = Panel("""Medical
Clinic""")
panel_4 = Panel("""Medication
Room""")
panel_5 = Panel("""Nurse
Station""")
panel_6 = Panel("""Utility
Room""")
panel_7 = Panel("Elevator")
panel_8 = Panel("""Elevator
Lobby""")
panel_9 = Panel("Pantry")
panel_10 = Panel("""Janitor
Closet""")

# ----
number_slider_6 = Slider(12, range=0..12)
explode = Explode(Curve=edges, Recursive=True)  # -> flatten(Segments), Vertices
crv = Curve(explode.Segments)

# ---- group: Labelling / Label Patient Room
item = ListItem(List=col, Index=0, Wrap=True)
textdot = DefineTextDot(Text=panel_2, Location=patient_room, Font="Arial", Size=number_slider_6)
material_2 = CreateMaterial(Diffuse=item, Specular=RGB(255, 255, 255), Emission=RGB(0, 0, 0), Transparency=0, Shine=0)
preview = CustomPreview(Geometry=textdot, Material=material_2)

# ---- group: Labelling / Label Nurse Station
item_2 = ListItem(List=col, Index=1, Wrap=True)
textdot_2 = DefineTextDot(Text=panel_5, Location=nurse_station, Font="Arial", Size=number_slider_6)
material_3 = CreateMaterial(Diffuse=item_2, Specular=RGB(255, 255, 255), Emission=RGB(0, 0, 0), Transparency=0, Shine=0)
preview_2 = CustomPreview(Geometry=textdot_2, Material=material_3)

# ---- group: Labelling / Label Utility Room
item_3 = ListItem(List=col, Index=2, Wrap=True)
textdot_3 = DefineTextDot(Text=panel_6, Location=utility_room, Font="Arial", Size=number_slider_6)
material_4 = CreateMaterial(Diffuse=item_3, Specular=RGB(255, 255, 255), Emission=RGB(0, 0, 0), Transparency=0, Shine=0)
preview_3 = CustomPreview(Geometry=textdot_3, Material=material_4)

# ---- group: Labelling / Label Elevator
item_4 = ListItem(List=col, Index=3, Wrap=True)
textdot_4 = DefineTextDot(Text=panel_7, Location=elevator, Font="Arial", Size=number_slider_6)
material_5 = CreateMaterial(Diffuse=item_4, Specular=RGB(255, 255, 255), Emission=RGB(0, 0, 0), Transparency=0, Shine=number_slider_6)
preview_4 = CustomPreview(Geometry=textdot_4, Material=material_5)

# ---- group: Labelling / Label Elevator Lobby
item_5 = ListItem(List=col, Index=4, Wrap=True)
textdot_5 = DefineTextDot(Text=panel_8, Location=elevator_lobby, Font="Arial", Size=number_slider_6)
material_6 = CreateMaterial(Diffuse=item_5, Specular=RGB(255, 255, 255), Emission=RGB(0, 0, 0), Transparency=0, Shine=0)
preview_5 = CustomPreview(Geometry=textdot_5, Material=material_6)

# ---- group: Labelling / Label Medical Clinic
item_6 = ListItem(List=col, Index=5, Wrap=True)
textdot_6 = DefineTextDot(Text=panel_3, Location=medical_clinic, Font="Arial", Size=number_slider_6)
material_7 = CreateMaterial(Diffuse=item_6, Specular=RGB(255, 255, 255), Emission=RGB(0, 0, 0), Transparency=0, Shine=0)
preview_6 = CustomPreview(Geometry=textdot_6, Material=material_7)

# ---- group: Labelling / Label Pantry
item_7 = ListItem(List=col, Index=6, Wrap=True)
textdot_7 = DefineTextDot(Text=panel_9, Location=pantry, Font="Arial", Size=number_slider_6)
material_8 = CreateMaterial(Diffuse=item_7, Specular=RGB(255, 255, 255), Emission=RGB(0, 0, 0), Transparency=0, Shine=0)
preview_7 = CustomPreview(Geometry=textdot_7, Material=material_8)

# ---- group: Labelling / Label Medication Room
item_8 = ListItem(List=col, Index=7, Wrap=True)
textdot_8 = DefineTextDot(Text=panel_4, Location=medication_room, Font="Arial", Size=number_slider_6)
material_9 = CreateMaterial(Diffuse=item_8, Specular=RGB(255, 255, 255), Emission=RGB(0, 0, 0), Transparency=0, Shine=0)
preview_8 = CustomPreview(Geometry=textdot_8, Material=material_9)

# ---- group: Labelling / Label Janitor Closet
item_9 = ListItem(List=col, Index=8, Wrap=True)
textdot_9 = DefineTextDot(Text=panel_10, Location=janitor_closet, Font="Arial", Size=number_slider_6)
material_10 = CreateMaterial(Diffuse=item_9, Specular=RGB(255, 255, 255), Emission=RGB(0, 0, 0), Transparency=0, Shine=0)
preview_9 = CustomPreview(Geometry=textdot_9, Material=material_10)

# ----
createlocationpairings = GhPythonScript(
    PatientRoom=patient_room,
    NurseStation=nurse_station,
    UtilityRoom=utility_room,
    Elevator=elevator,
    ElevatorLobby=elevator_lobby,
    MedicalClinic=medical_clinic,
    Pantry=pantry,
    MedicationRoom=medication_room,
    JanitorCloset=janitor_closet)  # -> out, PatientRoom_PatientRoom, NurseStation_PatientRoom, UtilityRoom_PatientRoom, NurseStation_UtilityRoom, NurseStation_Elevator, NurseStation_MedicalClinic, PatientRoom_Pantry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; inputs PatientRoom: list of Point3d, NurseStation: list of Point3d, UtilityRoom: list of Point3d, Elevator: list of Point3d, ElevatorLobby: list of Point3d, MedicalClinic: list of Point3d, Pantry: list of Point3d, MedicationRoom: list of Point3d, JanitorCloset: list of Point3d
# ---------- createlocationpairings: Python ----------
__author__ = "rapha"
__version__ = "2021.10.07"

import rhinoscriptsyntax as rs

def create_pairs(set1, set2, lines):
    for i in range(len(set1)):
        for j in range(len(set2)):
            p1 = set1[i]
            p2 = set2[j]
            
            # Do not consider paths that are too short.
            if rs.Distance(p1, p2) < 0.1:
                continue
            
            # Add a line between both locations.
            lines.append(rs.AddLine(p1, p2))

# Sets of pairs (connected by lines).
PatientRoom_PatientRoom = []
NurseStation_PatientRoom = []
UtilityRoom_PatientRoom = []
NurseStation_UtilityRoom = []
NurseStation_Elevator = []
NurseStation_MedicalClinic = []
PatientRoom_Pantry = []
PatientRoom_Elevator = []
MedicationRoom_PatientRoom = []
UtilityRoom_ElevatorLobby = []
UtilityRoom_MedicalClinic = []
UtilityRoom_Pantry = []
UtilityRoom_JanitorCloset = []
NurseStation_Pantry = []

# Fill pairs.
create_pairs(PatientRoom, PatientRoom, PatientRoom_PatientRoom)
create_pairs(NurseStation, PatientRoom, NurseStation_PatientRoom)
create_pairs(UtilityRoom, PatientRoom, UtilityRoom_PatientRoom)
create_pairs(NurseStation, UtilityRoom, NurseStation_UtilityRoom)
create_pairs(NurseStation, Elevator, NurseStation_Elevator)
create_pairs(NurseStation, MedicalClinic, NurseStation_MedicalClinic)
create_pairs(PatientRoom, Pantry, PatientRoom_Pantry)
create_pairs(PatientRoom, Elevator, PatientRoom_Elevator)
create_pairs(MedicationRoom, PatientRoom, MedicationRoom_PatientRoom)
create_pairs(UtilityRoom, ElevatorLobby, UtilityRoom_ElevatorLobby)
create_pairs(UtilityRoom, MedicalClinic, UtilityRoom_MedicalClinic)
create_pairs(UtilityRoom, Pantry, UtilityRoom_Pantry)
create_pairs(UtilityRoom, JanitorCloset, UtilityRoom_JanitorCloset)
create_pairs(NurseStation, Pantry, NurseStation_Pantry)
# ---------- end createlocationpairings ----------

pt = Point(<point referenced from the Rhino model>)
int = Integer(3)
vec = Vector(Vector(0, -3.300200792, 0))
pointlist = GhPythonScript(BasePoint=pt, Items=int, Displacement=vec)  # -> out, Positions; inputs BasePoint: Point3d, Items: Int32
# ---------- pointlist: Python ----------
__author__ = "rapha"
__version__ = "2021.10.08"

import rhinoscriptsyntax as rs

Positions = []

for i in range(Items):
    Positions.append(BasePoint + i * Displacement)
# ---------- end pointlist ----------
material_11 = CreateMaterial(
    Diffuse=[ColourSwatch(SwatchColor=RGB(244, 162, 97)), ColourSwatch(SwatchColor=RGB(233, 196, 106)), ColourSwatch(SwatchColor=RGB(42, 157, 143))],
    Specular=RGB(255, 255, 255),
    Emission=RGB(0, 0, 0),
    Transparency=0,
    Shine=0)

boundary_discretization = DivideDistance(Curve=layout_curves, Distance=resolution)  # -> flatten(Points), Tangents, Parameters
boundary = BoundarySurfaces(Edges=layout_curves)
duppt = RemoveDuplicatePts(Points=boundary_discretization.Points, Tolerance=0.01)
voronoi = Voronoi(Points=duppt, BruteForceOverride=False)
layout_curves_copy = Curve(layout_curves)
disc = Discontinuity(Curve=layout_curves_copy, Level=1)  # -> flatten(Points), Parameters

preview_10 = CustomPreview(Geometry=boundary, Material=material)

createmedialaxis = CSharpScript(
    voronoiDiagramCurveList=voronoi,
    boundaryCurveList=layout_curves,
    walkableSurfaceBrep=boundary,
    boundaryProximityTolerance=Slider(0.2, range=0..100))  # -> out, medialAxisCurveList; inputs voronoiDiagramCurveList: list of Curve, boundaryCurveList: list of Curve, walkableSurfaceBrep: Brep, boundaryProximityTolerance: Double
# ---------- createmedialaxis: C# usings ----------
using System.Linq;
# ---------- createmedialaxis: C# ----------
    // First "explode" all curves from the Voronoi-diagram into segments and eventually save them in array for parallel processing.
    List<Line> allSegments = new List<Line>();
    foreach (Curve curve in voronoiDiagramCurveList)
    {
      if (!curve.IsPolyline())
      {
        throw new Exception("Input curve was not polyline.");
      }
      Polyline polyline = new Polyline();
      curve.TryGetPolyline(out polyline);
      Line[] segments = polyline.GetSegments();
      foreach (Line segment in segments)
      {
        allSegments.Add(segment);
      }
    }

    Line[] allSegmentArray = allSegments.ToArray();
    bool[] mask = new bool[allSegmentArray.Length];
    System.Threading.Tasks.Parallel.For(0, mask.Length, i =>
    {
      mask[i] = SegmentApproximatesMedialAxis(allSegmentArray[i], boundaryCurveList, walkableSurfaceBrep, boundaryProximityTolerance);
    });
    List<Line> result = new List<Line>();
    for (int i = 0; i < allSegmentArray.Length; i++)
    {
      if (mask[i])
      {
        result.Add(allSegmentArray[i]);
      }
    }
    medialAxisCurveList = result;
# ---------- createmedialaxis: C# additional code ----------
  /// <summary>
  /// Checks if a segment belongs to the subgraph of the Voronoi-diagram that approximates the medial axis.
  /// </summary>
  /// <param name="segment">The segment for which to check.</param>
  /// <param name="boundaryCurves">The curves describing the boundary for which to find the medial axis.</param>
  /// <returns>true if is medial axis segment, false otherwise.</returns>
  private bool SegmentApproximatesMedialAxis(Line segment, List<Curve> boundaryCurves, Brep walkableSurfaceBrep, double closenessTolerance)
  {
    bool isIntersecting = SegmentIntersectsBoundary(segment, boundaryCurves, RhinoMath.SqrtEpsilon);
    bool isWalkable = SegmentIsOnWalkableSurface(segment, walkableSurfaceBrep, RhinoMath.SqrtEpsilon);
    bool isTooCloseToBoundary = SegmentIsTooCloseToBoundary(segment, boundaryCurves, closenessTolerance);
    return !isIntersecting && isWalkable && !isTooCloseToBoundary;
  }

  /// <summary>
  /// Checks whether a segment crosses the boundary or is close enough (within a tolerance) to it.
  /// </summary>
  /// <param name="segment">The segment for which to check whether it crosses the boundary.</param>
  /// <param name="boundaryCurves">The curves that define the boundary.</param>
  /// <param name="tolerance">The distance to the boundary must be larger than this to be non-crossing.</param>
  /// <returns>true if the segment crosses the boundary or is too close to it. false otherwise.</returns>
  private bool SegmentIntersectsBoundary(Line segment, List<Curve> boundaryCurves, double tolerance)
  {
    bool intersects = false;
    foreach (Curve boundaryCurve in boundaryCurves)
    {
      if (Rhino.Geometry.Intersect.Intersection.CurveCurve(boundaryCurve, segment.ToNurbsCurve(), tolerance, 0.0).Count != 0)
      {
        intersects = true;
        break;
      }
    }
    return intersects;
  }

  /// <summary>
  /// Checks whether a segment lies on the walkable surface.
  /// </summary>
  /// <param name="segment">The segment for which the property should be checked.</param>
  /// <param name="tolerance">Distance from curve to walkable surface must be smaller than this to count as "on walkable surface".</param>
  /// <param name="walkableSurfaceBrep">The walkable surface.</param>
  /// <returns>true if segment is on walkable surface (within tolerance), false otherwise.</returns>
  private bool SegmentIsOnWalkableSurface(Line segment, Brep walkableSurfaceBrep, double tolerance)
  {
    Curve segmentCurve = segment.ToNurbsCurve();
    Curve[] overlapCurves;
    Point3d[] intersectionPoints;
    Rhino.Geometry.Intersect.Intersection.CurveBrep(segmentCurve, walkableSurfaceBrep, tolerance, out overlapCurves, out intersectionPoints);
    return overlapCurves.Length > 0 || intersectionPoints.Length > 0;
  }

  /// <summary>
  /// Checks for a segment if it is too close to the boundary. It does that by comparing the distance of the endpoints of the segment to all boundary curves.
  /// </summary>
  /// <param name="segment">The segment to check for.</param>
  /// <param name="boundaryCurves">The curves that define the boundary.</param>
  /// <param name="tolerance">If the distance is smaller than this, the segment is considered to be too close.</param>
  /// <returns>true if is too close, false otherwise.</returns>
  private bool SegmentIsTooCloseToBoundary(Line segment, List<Curve> boundaryCurves, double tolerance)
  {
    Curve segmentCurve = segment.ToNurbsCurve();
    Point3d startPoint = segmentCurve.PointAtStart;
    Point3d endPoint = segmentCurve.PointAtEnd;
    for (int i = 0; i < boundaryCurves.Count; i++)
    {
      Curve currCurve = boundaryCurves[i];
      double startParam = 0.1f;
      currCurve.ClosestPoint(startPoint, out startParam);
      if (startPoint.DistanceTo(currCurve.PointAt(startParam)) < tolerance)
      {
        return true;
      }
      double endParam = 0.1f;
      currCurve.ClosestPoint(endPoint, out endParam);
      if (endPoint.DistanceTo(currCurve.PointAt(endParam)) < tolerance)
      {
        return true;
      }
    }
    return false;
  }
# ---------- end createmedialaxis ----------
scriptpar = ScriptParasite(Enable=toggle, Folder=panel)

dupln = RemoveDuplicateLines(Lines=createmedialaxis.medialAxisCurveList, Tolerance=0.01)
join = JoinCurves(Curves=dupln, Preserve=False)  # -> reparameterize(Curves)
python_2 = GhPythonScript(raw_medial_axis_curves=join)  # -> out, medial_axis_curves, boolean_curves; inputs raw_medial_axis_curves: list of Curve
# ---------- python_2: Python ----------
__author__ = "rapha"
__version__ = "2021.09.09"

import rhinoscriptsyntax as rs

def clean_up_medial_axes(medial_axes):
    """
    Removes redundant medial axes and orders the remaining ones by decreasing
    length.
    
    Parameters
    ----------
    medial_axes : [Curve]
        A set of curves whose union constitutes the medial axis.
    
    Returns
    -------
        [Curve]
        A set with the same union as the input set, but with redundant curves 
        removed. Curves are ordered by length in decreasing order.
    """
    
    # First order by decreasing length.
    lens = [rs.CurveLength(med_ax) for med_ax in medial_axes]
    med_lens = zip(medial_axes, lens)
    med_lens = sorted(med_lens, key=lambda x: x[1], reverse=True)
    medial_axes = list(zip(*med_lens)[0])
    
    # Now perform check if larger curves completely covers other curve.
    dead = len(medial_axes) * [False]
    for i in range(len(medial_axes)):
        if dead[i]:
            continue
        for j in range(i + 1, len(medial_axes)):
            if dead[j]:
                continue
            large_crv = medial_axes[i]
            small_crv = medial_axes[j]
            intersection = rs.CurveCurveIntersection(large_crv, small_crv)
            if intersection:
                for info in intersection:
                    if info[0] == 2:
                        if (info[7] == 0.0 and info[8] == 1.0 or info[7] == 1.0 and info[8] == 0.0):
                            dead[j] = True
    new_medial_axes = []
    for i in range(len(medial_axes)):
        if not dead[i]:
            new_medial_axes.append(medial_axes[i])
    return new_medial_axes
    
medial_axis_curves = clean_up_medial_axes(raw_medial_axis_curves)
boolean_curves = rs.CurveBooleanUnion(raw_medial_axis_curves)
# ---------- end python_2 ----------
findbranchpoints = GhPythonScript(
    segments=createmedialaxis.medialAxisCurveList,
    min_angle=number_slider_4,
    max_angle=number_slider_5,
    boundary_segments=layout_curves)  # -> out, branch_points, min_radii; inputs segments: list of Curve, boundary_segments: list of Curve
# ---------- findbranchpoints: Python ----------
"""
Finds branch points in medial axis segments.

Parameters
----------

Returns
-------
"""

__author__ = "rapha"
__version__ = "2021.09.15"

import rhinoscriptsyntax as rs
import ghpythonlib.parallel as para
import math

def find_branch_points(segments, min_thresh, max_thresh):
    branch_points = []
    for i in range(len(segments) - 1):
        curr_seg = segments[i]
        next_seg = segments[i + 1]
        intersect = rs.CurveCurveIntersection(curr_seg, next_seg)
        if not intersect:
            continue
        if intersect[0][0] == 2:
            continue
        angle = min(rs.Angle2(curr_seg, next_seg))
        common = intersect[0][1]
        if (angle > min_thresh and angle < max_thresh):
            if not any([rs.PointCompare(common, bp) for bp in branch_points]):
                branch_points.append(common)
    return branch_points

# Find branch-points.
branch_points = find_branch_points(segments, min_angle, max_angle)

# For each branch point, find minimal distance to boundary.
min_radii = []
for branch_point in branch_points:
    closest_params = [rs.CurveClosestPoint(boundary, branch_point) for boundary in boundary_segments]
    closest_points = [rs.EvaluateCurve(boundary, closest_param) for (boundary, closest_param) in zip(boundary_segments, closest_params)]
    dists = [rs.Distance(branch_point, closest_point) for closest_point in closest_points]
    min_radii.append(min(dists))
# ---------- end findbranchpoints ----------
join_2 = JoinCurves(Curves=python_2.medial_axis_curves, Preserve=False)
medial_axis_classifier = GhPythonScript(
    corners=disc.Points,
    initial_stepsize=number_slider_3,
    displacement_tol_fac=number_slider_2,
    medial_axis_curves=python_2.medial_axis_curves,
    boundary_curves=layout_curves_copy,
    branch_points=findbranchpoints.branch_points)  # -> out, segment_curves, segment_types, convex_surfaces, closest_branchpoint; inputs corners: list of Point3d, medial_axis_curves: list of Curve, boundary_curves: list, branch_points: list of Point3d
# ---------- medial_axis_classifier: Python ----------
__author__ = "rapha"
__version__ = "2021.09.06"

import rhinoscriptsyntax as rs
import ghpythonlib.parallel as para
import time

class MedialAxisSegment:
    def __init__(self,
                 start_point_descriptor,
                 end_point_descriptor,
                 over_true_time):
        
        # Start and endpoint must be from the same medial axis to form valid segment.
        if (start_point_descriptor.medial_axis != end_point_descriptor.medial_axis):
            raise Exception("Start- and end-point were not extracted from the same medial axis curve")
        
        self.start_pd = start_point_descriptor
        self.end_pd = end_point_descriptor
        self.segment_curve = self.get_segment_curve()
        self.type = self.get_segment_type()
        self.over_true_time = over_true_time
    
    def get_segment_curve(self):
        medial_axis = self.start_pd.medial_axis
        start_time = self.start_pd.time
        end_time = self.end_pd.time
        if (start_time == end_time):
            return None
        return rs.AddSubCrv(medial_axis, start_time, end_time)
    
    def get_segment_type(self):
        return self.end_pd.type
   
    def get_start_time(self):
        return self.start_pd.time
    
    def get_end_time(self):
        return self.end_pd.time
    
    def get_start_point(self):
        medial_axis = self.start_pd.medial_axis
        start_time = self.start_pd.time
        return rs.EvaluateCurve(medial_axis, start_time)
    
    def get_end_point(self):
        medial_axis = self.end_pd.medial_axis
        end_time = self.end_pd.time
        return rs.EvaluateCurve(medial_axis, end_time)
    
    def get_start_symm_chord(self):
        return rs.AddLine(self.start_pd.equi_point_1, self.start_pd.equi_point_2)
    
    def get_end_symm_chord(self):
        return rs.AddLine(self.end_pd.equi_point_1, self.end_pd.equi_point_2)
    
    def is_adjacent_to_branch_point(self, branch_point, tol):
        start_is_close = rs.Distance(self.get_start_point(), branch_point) < tol
        end_is_close = rs.Distance(self.get_end_point(), branch_point) < tol
        return start_is_close or end_is_close
    
    def get_convex_surface(self):
        sp1 = self.start_pd.equi_point_1
        sp2 = self.start_pd.equi_point_2
        ep1 = self.end_pd.equi_point_1
        ep2 = self.end_pd.equi_point_2
        points = [sp1, sp2, ep1, ep2]
        
        # List which will contain boundaries of convex shape.
        lines = []
        sp1_sp2_tiny = rs.IsVectorTiny(rs.VectorSubtract(sp1, sp2))
        ep1_ep2_tiny = rs.IsVectorTiny(rs.VectorSubtract(ep1, ep2))
        sp1_ep1_tiny = rs.IsVectorTiny(rs.VectorSubtract(sp1, ep1))
        sp2_ep2_tiny = rs.IsVectorTiny(rs.VectorSubtract(sp2, ep2))
        sp1_ep2_tiny = rs.IsVectorTiny(rs.VectorSubtract(sp1, ep2))
        sp2_ep1_tiny = rs.IsVectorTiny(rs.VectorSubtract(sp2, ep1))
        
        # Symmetric choords should never be points (if approximated).
        if (sp1_sp2_tiny or ep1_ep2_tiny or sp1_ep2_tiny or sp2_ep1_tiny):
            return None
        
        # If the points on either side are identical, and on the other side they
        # are not, then the convex shape is a triangle.
        elif (sp1_ep1_tiny and not sp2_ep2_tiny):
            lines.append(rs.AddLine(sp2, ep2))
            lines.append(rs.AddLine(sp1, sp2))
            lines.append(rs.AddLine(ep1, ep2))
        elif (sp2_ep2_tiny and not sp1_ep1_tiny):
            lines.append(rs.AddLine(sp1, ep1))
            lines.append(rs.AddLine(sp1, sp2))
            lines.append(rs.AddLine(ep1, ep2))
        
        # If all points are distinct, the surface is a quadrilateral.
        elif (not sp1_ep1_tiny and not sp2_ep2_tiny):
            # Diagonal check.
            temp_conn_1 = rs.AddLine(sp1, ep1)
            temp_conn_2 = rs.AddLine(sp2, ep2)
            if (rs.CurveCurveIntersection(temp_conn_1, temp_conn_2)):
                temp = ep1
                ep1 = ep2
                ep2 = temp
            lines.append(rs.AddLine(sp1, sp2))
            lines.append(rs.AddLine(sp2, ep2))
            lines.append(rs.AddLine(ep2, ep1))
            lines.append(rs.AddLine(ep1, sp1))
        else:
            return None
        # Else we are in a degenerate case which is a bug.
        """
        else:
            raise Exception("All points are equal. This should be the case")
        """
        # Now we can construct the surface.
        srf = rs.AddPlanarSrf(lines)
        if (srf):
            return srf[0]
        else:
            return None


class MedialAxisPointDescriptor:
    def __init__(self,
                 medial_axis,
                 time,
                 type,
                 equi_point_1,
                 equi_point_2,
                 boundary_segment_id_1,
                 boundary_segment_id_2):
        self.medial_axis = medial_axis
        self.time = time
        self.type = type
        
        # Check if equidistant points are distinct.
        """
        if (rs.PointCompare(equi_point_1, equi_point_2)):
            raise Exception("Equidistant points are same in MedialAxisPointDescriptor construction")
        """
        
        self.equi_point_1 = equi_point_1
        self.equi_point_2 = equi_point_2
        self.boundary_segment_id_1 = boundary_segment_id_1
        self.boundary_segment_id_2 = boundary_segment_id_2


def are_points_distinct(pd1, pd2):
    """
    Checks whether two points on the medial axis belong to different segments.
    
    Parameters
    ----------
    pd1 : MedialAxisPointDescriptor
        Descriptor of the first point to compare.
    pd2 : MedialAxisPointDescriptor
        Descriptor of the second point to compare.
    
    Returns
    -------
    bool
        True if either the points belong to different segment types or if the 
        their closest boundary-segments are distinct. False otherwise.
   """
    
    # First check if the points are of the same type.
    if (pd1.type != pd2.type):
        return True
    
    if (pd1.boundary_segment_id_1 != pd2.boundary_segment_id_1 or
        pd1.boundary_segment_id_2 != pd2.boundary_segment_id_2):
        return True
    
    # Otherwise the points lie on the same segment.
    return False


def are_segments_distinct(s1, s2):
    """
    Checks if two segments are distinct.
    
    Parameters
    ----------
    s1 : MedialAxisSegment
        Descriptor of the first segment to compare.
    s2 : MedialAxisSegment
        Descriptor of the second segment to compare.
    
    Returns
    -------
    bool
        True if the segments are distinct (False otherwise), i.e. if their 
        start- and end-locations are distinct (the flipped order is also 
        checked, in case one segment is just a reversed version of the other). 
        TODO: Implement a better check as soon as generate_segment implements
        more accurate way of classifying segment. Current check should be
        sufficient though.
    """
    start1 = s1.get_start_point()
    end1 = s1.get_end_point()
    start2 = s2.get_start_point()
    end2 = s2.get_end_point()
    
    # TODO: Current tolerance is quite large, find better way to set it.
    same_dir = rs.Distance(start1, start2) < 0.5 and rs.Distance(end1, end2) < 0.5
    oppo_dir = rs.Distance(start1, end2) < 0.5 and rs.Distance(end1, start2) < 0.5
    
    return not same_dir and not oppo_dir
 
 
def generate_segments(medial_axis, corners, boundary_segments, stepsize, tolerance):
    """
    Segments and classifies the medial axis.
    
    Parameters
    ----------
    medial_axis : Curve
        Curve that corresponds to the medial axis.
    corners: [Point]
        Points that correspond to the corners of the boundary curves.
    boundary_segments: [Curve]
        Curves that correspond to the exploded boundary. One element must 
        represent a single straight wall.
    stepsize: float
        Stepsize with which the medial axis should be iterated over initially.
    tolerance: float
        Maximal error tolerated when determining end/start-point of a segment.
    
    Raises
    ------
        Raises exception if program is assumed to be in an infinity loop. This
        happens after 10'000 iterations of the stepping procedure and can
        produce false positives.
    
    Returns
    -------
    [MedialAxisSegment]
        Each element corresponds to a segment of the medial axis. Segments are
        unique, but in no particular order.
    """
    
    # Start at the beginning of the medial axis.
    last_seg = generate_segment(medial_axis, 
                                0.0,
                                0.0,
                                corners,
                                boundary_segments,
                                stepsize,
                                tolerance)
    
    segments = []
    
    # TODO: Remove after more testing.
    # Prevents script of getting stuck in while loop.
    iter = 0
    max_iter = 1000
    
    # Step through medial axis and create segments. We can assume that the last
    # segment will have end-time >= 1.0, so we can stop if that occurs.
    safe_time = 0.0
    time = 0.0
    while (safe_time < 1.0):
        
        # The safe_time should always underestimate the real time.
        if (safe_time > time):
            print "safe_time: " + str(safe_time)
            print "time: " + str(time)
            raise Exception("Safe time was larger than actual time")
        
        # TODO: Remove after more testing.
        iter += 1
        if (iter > max_iter):
            raise Exception("Probably stuck in a while loop")
        
        # Create next segment starting from the end-time of last segment.
        # We can do this as the last segment will always overshoot the true
        # segment end by a bit ==> will not get stuck at same end as before.
        curr_seg = generate_segment(medial_axis,
                                    safe_time,
                                    time,
                                    corners,
                                    boundary_segments,
                                    stepsize,
                                    tolerance)
        
        segments.append(curr_seg)
        
        # Always update time, otherwise do not move on medial axis.
        safe_time = curr_seg.get_end_time()
        time = curr_seg.over_true_time
    
    return segments


def generate_segment(medial_axis, safe_time, time, corners, boundary_segments, stepsize, tolerance):
    """
    Finds a single segment on the medial axis from some starting time onwards.
    
    Parameters
    ----------
    medial_axis : Curve
        See generate_segments.
    time : float
        Parameter at which to begin this segment on medial axis.
    corners : [Point]
        See generate_segments.
    boundary_segments: [Curve]
        See generate_segments.
    stepsize:
        See generate_segments.
    tolerance:
        See generate_segments.
        
    Raises
    ------
        See generate_segments.
    
    Returns
    -------
    MedialAxisSegment
        The segment of the medial axis starting at parameter time.
    """
    
    # Information about the start point of the segment.
    # "pd" is short for point-descriptor.
    start_pd = classify_point(medial_axis, time, corners, boundary_segments)
    
    # The point-descriptor which is still on the current segment.
    curr_pd = start_pd
    next_pd = None
    
    # Initial step.
    next_time = time + stepsize
    
    # Iterate over medial_axis until either:
    # 1. the stepsize is smaller than our error-tolerance.
    # 2. the end of the medial axis was reached.
    
    # TODO: Remove after more testing.
    max_iter = 10000
    iter = 0
    over_true_time = 0.0
    while (stepsize > tolerance and time <= 1.0):
        
        # TODO: Remove after more testing.
        iter += 1
        if (iter > max_iter):
            raise Exception("Probably stuck in a while loop")
        
        # Get the point-descriptor at the next step.
        next_pd = classify_point(medial_axis, next_time, corners, boundary_segments)
        
        # Check if the current and next point belong to the same segment, else
        # we reduce the step-size. Else, we are safe to progress to the next 
        # time point.
        if (are_points_distinct(curr_pd, next_pd)):
            over_true_time = next_time
            # TODO: Find better way to reduce step-size.
            stepsize /= 2.0
        else:
            curr_pd = next_pd
            time = next_time
        next_time = time + stepsize
    
    # We might have left the while loop because we reached the end of the medial
    # line ==> we could make our result more accurate by evaluating at the end
    # the medial axis.
    if (time > 1.0):
        next_pd = classify_point(medial_axis, 1.0, corners, boundary_segments)
    
    # Construct and return a new segment-descriptor from the start- and end-points.
    medial_axis_segment = MedialAxisSegment(start_pd, curr_pd, over_true_time)
    
    return medial_axis_segment


def are_points_distinct(pd1, pd2):
    """
    Checks whether two points on the medial axis belong to different segments.
    
    Parameters
    ----------
    pd1 : MedialAxisPointDescriptor
        Descriptor of the first point to compare.
    pd2 : MedialAxisPointDescriptor
        Descriptor of the second point to compare.
    
    Returns
    -------
    bool
        True if either the points belong to different segment types or if the 
        their closest boundary-segments are distinct. False otherwise.
   """
    
    # First check if the points are of the same type.
    if (pd1.type != pd2.type):
        return True
    
    if (pd1.boundary_segment_id_1 != pd2.boundary_segment_id_1 or
        pd1.boundary_segment_id_2 != pd2.boundary_segment_id_2):
        return True
    
    # Otherwise the points lie on the same segment.
    return False


def classify_point(medial_axis, time, corners, boundary_segments):
    """
    Classifies the medial-axis-segment-type of the point.
    
    Parameters
    ----------
    medial_axis : Curve
        See generate_segments.
    time : float
        Parameter of the point to be evaluated on the medial axis.
    corners : [Point]
        See generate_segments.
    boundary_segments : [Curve]
        See generate_segments.
    
    Returns
    -------
    MedialAxisPointDescriptor
        Descriptor of the point on the medial axis.
    """
    
    # Extract the point on the medial axis.
    point = rs.EvaluateCurve(medial_axis, time)
    
    # Find the closest points.
    closest_points = [rs.EvaluateCurve(x, rs.CurveClosestPoint(x, point)) for x in boundary_segments]
    
    # Calculate distances to closest points.
    distances = [rs.Distance(x, point) for x in closest_points]
    
    # Combine points, distances, corresponding segments into list.
    # Also add indices to allow for reordering of segments in point-descriptor 
    # construction.
    equi_point_descs = zip(distances, 
                           closest_points, 
                           boundary_segments, 
                           list(range(len(boundary_segments))))
    
    # Sorting not necessary, since we only need to extract the two smallest distances. 
    # First, find point with closest distance.
    symm_chord_desc = []
    min_dist = equi_point_descs[0][0]
    min_equi_pt = equi_point_descs[0]
    min_idx = 0
    for i in range(1, len(equi_point_descs)):
        if (min_dist > equi_point_descs[i][0]):
            min_dist = equi_point_descs[i][0]
            min_equi_pt = equi_point_descs[i]
            min_idx = i
    symm_chord_desc.append(min_equi_pt)
    del equi_point_descs[min_idx]
    
    # Find second closest point.
    min_dist = float("inf")
    min_equi_pt = None
    for i in range(len(equi_point_descs)):
        
        # Now we also need to check whether the second point is indeed distinct.
        if (min_dist > equi_point_descs[i][0] and rs.Distance(equi_point_descs[i][1], symm_chord_desc[0][1]) > 0.1):
            min_dist = equi_point_descs[i][0]
            min_equi_pt = equi_point_descs[i]
    symm_chord_desc.append(min_equi_pt)
    
    # Reorder primitive descriptors based on segment id.
    if (symm_chord_desc[0][3] > symm_chord_desc[1][3]):
        symm_chord_desc = [symm_chord_desc[1], symm_chord_desc[0]]
    
    # Check if points are corners.
    p1 = symm_chord_desc[0][1]
    p2 = symm_chord_desc[1][1]
    p1_is_corner = [rs.PointCompare(x, p1) for x in corners]
    p2_is_corner = [rs.PointCompare(x, p2) for x in corners]
    p1_is_corner = any(p1_is_corner)
    p2_is_corner = any(p2_is_corner)
    
    # Classify segment.
    type = "unknown"
    if (not p1_is_corner and not p2_is_corner):
        type = "normal"
    elif (p1_is_corner != p2_is_corner):
        type = "semi-ligature"
    else:
        type = "full-ligature"
    
    # Construct and return point descriptor.
    point_descriptor = MedialAxisPointDescriptor(medial_axis,
                                                 time,
                                                 type,
                                                 p1,
                                                 p2,
                                                 symm_chord_desc[0][3],
                                                 symm_chord_desc[1][3])
    return point_descriptor


def assign_color(seg, normal, semi, full):
    if seg.type == "normal":
        return normal
    elif seg.type == "semi-ligature":
        return semi
    else:
        return full


def generate_boundary_segments(boundary_curves):
    """
    Creates a set of boundary curves, each corresponding to a wall.
    """
    boundary_segments = []
    for boundary_curve in boundary_curves:
        
        # Assuming explode-curves generates segments that are adjacent.
        raw_segments = rs.ExplodeCurves(boundary_curve)
        start_idx = len(boundary_segments)
        
        unjoined = [raw_segments[0]]
        for i in range(1, len(raw_segments)):
            curr_seg = raw_segments[i]
            last_seg = unjoined[len(unjoined) - 1]
            curr_vec = rs.VectorSubtract(rs.CurveEndPoint(curr_seg), rs.CurveStartPoint(curr_seg))
            last_vec = rs.VectorSubtract(rs.CurveEndPoint(last_seg), rs.CurveStartPoint(last_seg))
            if (not rs.IsVectorParallelTo(curr_vec, last_vec)):
                if (len(unjoined) >= 2):
                    boundary_segments.append(rs.JoinCurves(unjoined)[0])
                else:
                    boundary_segments.append(last_seg)
                
                # Since the was a discontinuity, we need to delete all previous
                # joinable segments.
                del unjoined[:]
            unjoined.append(curr_seg)
        
        # Add the remaining segments.
        if (len(unjoined) >= 2):
            boundary_segments.append(rs.JoinCurves(unjoined)[0])
        else:
            boundary_segments.append(unjoined[len(unjoined) - 1])
    return boundary_segments

def find_stepsize_tolerance(medial_axis):
    medial_axis_len = rs.CurveLength(medial_axis)
    steps = medial_axis_len / initial_stepsize
    stepsize = 1.0 / steps
    tolerance = stepsize / displacement_tol_fac
    return [stepsize, tolerance]


def is_adjacent_to_branch_point(segment, branch_points, tol):
    adj = [segment.is_adjacent_to_branch_point(bp, tol) for bp in branch_points]
    bps = []
    if any(adj):
        for i in range(len(branch_points)):
            if adj[i]:
                bps.append(branch_points[i])
    else:
        return []


start_time = time.time()

# Divide boundary curves into boundary segments.
boundary_segments = generate_boundary_segments(boundary_curves)

# Go through each medial axis and extract segments.
segments = para.run(lambda x: generate_segments(x, corners, boundary_segments, find_stepsize_tolerance(x)[0], find_stepsize_tolerance(x)[1]), medial_axis_curves, True)

segment_curves = [seg.segment_curve for seg in segments]
segment_types = [seg.type for seg in segments]
try:
    convex_surfaces = [seg.get_convex_surface() for seg in segments]
except:
    pass
closest_branchpoint = para.run(lambda x: is_adjacent_to_branch_point(x, branch_points, 0.1), segments, False)

print "Number of segments generated: " + str(len(segments))
end_time = time.time()
print "Total time: " + str(end_time - start_time)
# ---------- end medial_axis_classifier ----------
createconvexpartition = GhPythonScript(
    medax_sgmts=medial_axis_classifier.segment_curves,
    convex_srfs=medial_axis_classifier.convex_surfaces,
    tps=medial_axis_classifier.segment_types,
    layout_srf=boundary,
    closest_branchpoint=medial_axis_classifier.closest_branchpoint,
    branch_points=findbranchpoints.branch_points,
    boundary_crvs=layout_curves,
    min_radii=findbranchpoints.min_radii)  # -> out, nodes, edges, srfs, colors, segs, degrees; inputs medax_sgmts: list of Curve, convex_srfs: list of Brep, tps: list, layout_srf: Brep, closest_branchpoint: list, branch_points: list of Point3d, boundary_crvs: list of Curve, min_radii: list
# ---------- createconvexpartition: Python ----------
__author__ = "rapha"
__version__ = "2021.09.20"

import rhinoscriptsyntax as rs
import time
import ghpythonlib.parallel as para
import ghpythonlib.components as ghcomp
import ghpythonlib.treehelpers as th
import Rhino.Geometry
from itertools import chain, combinations
import random
import math

class Node():
    
    def __init__(self, sgmt, srf, tp, bp):
        if isinstance(sgmt, list):
            self.sgmt = sgmt
        else:
            self.sgmt = [sgmt]
        self.srf = srf
        self.tp = tp
        self.bp = bp
        self.centroid = self.get_centroid()
    
    def get_centroid(self):
        if not self.srf:
            self.centroid = None
            return
        return rs.SurfaceAreaCentroid(self.srf)[0]


def flatten(l):
    return [item for sublist in l for item in sublist]


def are_nodes_adjacent(node1, node2, tol):
    sgmts1 = node1.sgmt
    sgmts2 = node2.sgmt
    for sgmt1 in sgmts1:
        for sgmt2 in sgmts2:
            are_sgmts_adj = are_crvs_adjacent(sgmt1, sgmt2, tol)
            if are_sgmts_adj:
                return True
    return False


def are_crvs_adjacent(crv1, crv2, tol):
    s1 = rs.CurveStartPoint(crv1)
    e1 = rs.CurveEndPoint(crv1)
    s2 = rs.CurveStartPoint(crv2)
    e2 = rs.CurveEndPoint(crv2)
    hd_hd = rs.Distance(s1, s2) < tol
    hd_tl = rs.Distance(s1, e2) < tol
    tl_hd = rs.Distance(e1, s2) < tol
    tl_tl = rs.Distance(e1, e2) < tol
    return hd_hd or hd_tl or tl_hd or tl_tl or rs.CurveCurveIntersection(crv1, crv2)


def is_srf_covered(srf1, srf2, tol):
    points = srf2.DuplicateVertices()
    closest_params = [rs.SurfaceClosestPoint(srf1, point) for point in points]
    closest_points = [rs.EvaluateSurface(srf1, param[0], param[1]) for param in closest_params]
    distances = [rs.Distance(point, closest_point) for (point, closest_point) in zip(points, closest_points)]
    return all([dist < tol for dist in distances])


def visualize_graph(graph):
    centroids = []
    edges = []
    for node in graph:
        if node.srf:
            centroids.append(node.centroid)
    for node in graph:
        if not node.srf:
            continue
        for neighbor in graph[node]:
            if not neighbor.srf:
                continue
            else:
                try:
                    edges.append(rs.AddLine(node.centroid, neighbor.centroid))
                except:
                    continue
    return centroids, edges


def are_points_far_from_curve(curve, points, tol):
    closest_params = [rs.CurveClosestPoint(curve, point) for point in points]
    closest_points = [rs.EvaluateCurve(curve, param) for param in closest_params]
    distances = [rs.Distance(closest_point, point) for (closest_point, point) in zip(closest_points, points)]
    return any([dist > tol for dist in distances])


def merge_same_tp_nodes(graph, tp):
    nodes = [node for node in graph]
    for node in nodes:
        if node.tp != tp:
            continue
        try:
            graph[node]
        except:
            continue
        # Find maximal connected subgraph starting from current node of tp.
        queue = [node]
        visited = []
        neighbors = []
        while len(queue) > 0:
            curr_node = queue.pop()
            if curr_node in visited:
                continue
            visited.append(curr_node)
            for neighbor in graph[curr_node]:
                if neighbor in visited:
                    continue
                if neighbor.tp != tp:
                    if neighbor not in neighbors:
                        neighbors.append(neighbor)
                    continue
                queue.append(neighbor)
        
        # Solitary normal surface.
        if len(visited) == 1:
            continue
        
        # Should not happen, but we need to check if the set of corners is convex.
        if not are_nodes_convex(visited, 0.1):
            continue
        
        # Create new node by combining surfaces and joining segments.
        new_node = merge_nodes(visited, tp)
        
        # Remove old nodes and maintain connection.
        for visit in visited:
            remove_node(graph, visit)
        graph[new_node] = neighbors
        for neighbor in neighbors:
            graph[neighbor].append(new_node)


def powerset(iterable):
    s = list(iterable)
    return chain.from_iterable(combinations(s, r) for r in range(len(s)+1))


def are_nodes_convex(nodes, tol):
    """
    Compares points to their convex hull. If the distance is too large,
    point is set is is assumed to not be convex.
    """
    try:
        corners = [node.srf.DuplicateVertices() for node in nodes]
    except:
        print [node.srf for node in nodes]
        raise Exception("Fodes")
    corners_flat = flatten(corners)
    return are_points_convex(corners_flat, tol)


def are_points_convex(points, tol):
    convex_hull = ghcomp.ConvexHull(points)[0]
    return not are_points_far_from_curve(convex_hull, points, tol)


def simple_srf_compare(srf1, srf2):
    return rs.Distance(rs.SurfaceAreaCentroid(srf1)[0], rs.SurfaceAreaCentroid(srf2)[0]) < 0.1


def remove_node(graph, node):
    del graph[node]
    for remaining in graph:
        if node in graph[remaining]:
            graph[remaining].remove(node)


def join_srfs(nodes):
    """
    Creates a surface covering all surfaces corresponding to nodes.
    """
    srfs = [node.srf for node in nodes]
    corners = flatten([srf.DuplicateVertices() for srf in srfs])
    return create_srf_from_points(corners)


def create_srf_from_points(points):
    convex_hull = ghcomp.ConvexHull(points)[0]
    srf = rs.AddPlanarSrf([convex_hull])
    if srf:
        return rs.coercebrep(srf[0])
    else:
        return None


def merge_branchpoints(nodes):
    bps = flatten([node.bp for node in nodes])
    return list(set(bps))


def is_adjacent_to_branchpoint(sgmt, branch_point, tol):
    start_is_close = rs.Distance(rs.CurveStartPoint(sgmt), branch_point) < tol
    end_is_close = rs.Distance(rs.CurveEndPoint(sgmt), branch_point) < tol
    return start_is_close or end_is_close


def merge_nodes(nodes, tp):
    new_srf = join_srfs(nodes)
    if not new_srf:
        raise Exception("Null surface created.")
    new_sgmt = flatten([node.sgmt for node in nodes])
    bps = []
    for node in nodes:
        for b in node.bp:
            if not b in bps:
                bps.append(b)
    return Node(new_sgmt, new_srf, tp, bps)


def merge_around_ligature(graph, ligature_node):
    if not ligature_node.srf:
        return
    # Get all normal-neighbors.
    norm_neighbors = [node for node in graph[ligature_node] if (node.tp == "normal" and node.srf)]
    if len(norm_neighbors) == 0:
        return
    
    # Get all subsets of neighbors.
    subsets = powerset(norm_neighbors)
    
    # For each subset of nodes, check if merged node would be convex.
    # If so, remember the size of the merged node and eventually select the merge
    # which yields the largest convex space.
    max_subset = None
    max_area = 0.0
    for subset in subsets:
        subset = list(subset)
        if len(subset) == 0:
            continue
        to_be_merged = [ligature_node] + subset
        if not are_nodes_convex(to_be_merged, 0.1):
            continue
        new_srf = join_srfs(to_be_merged)
        new_area = rs.SurfaceArea(new_srf)
        if rs.SurfaceArea(new_srf) > max_area:
            max_subset = to_be_merged
            max_area = new_area
    if not max_subset:
        print "No subset of nodes was found."
        return
    
    # Neighbors adjacent to nodes being removed (remove all that are actually in
    # the subset to be removed.
    new_neighbors = flatten([graph[n] for n in max_subset])
    for old in max_subset:
        new_neighbors = [neigh for neigh in new_neighbors if neigh != old]
    
    # Remove old nodes and add new one.
    for node in max_subset:
        remove_node(graph, node)
    new_node = merge_nodes(max_subset, "normal")
    graph[new_node] = new_neighbors
    for neigh in new_neighbors:
        try:
            graph[neigh].append(new_node)
        except:
            continue
    return new_node


def create_order(semi, min_radii):
    if len(semi.bp) == 0:
        return float("inf")
    elif len(semi.bp) == 1:
        return min_radii[semi.bp[0]]
    else:
        return min([min_radii[idx] for idx in semi.bp])


def input_preprocessing(medax_sgmts, convex_srfs, tps):
    input_data = zip(medax_sgmts, convex_srfs, tps)
    filtered_data = filter(lambda x: x[0] and rs.CurveLength(x[0]) > 0.5, input_data)
    data = []
    for d in filtered_data:
        if d[2] == "full-ligature":
            data.append(d)
            continue
        if not d[1]:
            continue
        data.append(d)
    print "lost " + str(len(filtered_data) - len(data)) + " segments."
    unzipped_data = zip(*data)
    medax_sgmts, convex_srfs, tps = unzipped_data[0], unzipped_data[1], unzipped_data[2]
    return medax_sgmts, convex_srfs, tps


def branchpoint_adjacency(medax_sgmts, branch_points):
    closest_branchpoint = []
    for sgmt in medax_sgmts:
        bps = []
        for i in range(len(branch_points)):
            if is_adjacent_to_branchpoint(sgmt, branch_points[i], 0.1):
                bps.append(i)
        closest_branchpoint.append(bps)
    return closest_branchpoint


def remove_invalid_srfs(nodes, boundary_crvs, layout_srf):
    new_nodes = []
    for node in nodes:
        if not node.centroid:
            new_nodes.append(node)
            continue
        
        # Remove nodes whose centroid is too close to the boundary.
        closest_params = [rs.CurveClosestPoint(boundary_crv, node.centroid) for boundary_crv in boundary_crvs]
        closest_points = [rs.EvaluateCurve(boundary_crv, closest_param) for (closest_param, boundary_crv) in zip(closest_params, boundary_crvs)]
        distances = [rs.Distance(node.centroid, closest_point) for closest_point in closest_points]
        if any([dist < 0.05 for dist in distances]):
            continue
        if rs.IsPointOnSurface(layout_srf, node.centroid):
            new_nodes.append(node)
    return new_nodes


def create_graph(nodes):
    graph = {}
    for node in nodes:
        graph[node] = []
    for i in range(len(nodes)):
        node1 = nodes[i]
        for j in range(len(nodes)):
            if i == j:
                continue
            node2 = nodes[j]
            if (are_nodes_adjacent(node1, node2, 0.25)):
                graph[node1].append(node2)
    return graph


def merge_around_semi_ligs(graph):
    semis = [node for node in graph if node.tp == "semi-ligature"]
    radii = [create_order(semi, min_radii) for semi in semis]
    
    # Order semi-ligatures by descending size of their maximally inscribed circles.
    semis_radii = zip(semis, radii)
    semis_radii = sorted(semis_radii, key=lambda x: x[1], reverse=True)
    semis = zip(*semis_radii)[0]
    for i in range(len(semis)):
        semi = semis[i]
        merge_around_ligature(graph, semi)


def create_full_lig_graph(graph):
    full_lig_graph = {}
    # Populate graph with nodes that correspond to full ligatures.
    for node in graph:
        if node.tp == "full-ligature":
            full_lig_graph[node] = []
    
    # For each full-ligature node, start BFS and add all nodes that are reached and 
    # are of tp full-ligature.
    for full_lig_node in full_lig_graph:
        visited = []
        queue = [full_lig_node]
        visited = []
        while len(queue) > 0:
            curr_node = queue.pop()
            if curr_node in visited:
                continue
            visited.append(curr_node) 
            for neighbor in graph[curr_node]:
                if neighbor in visited:
                    continue
                if neighbor.tp == "full-ligature":
                    queue.append(neighbor)
        full_lig_graph[full_lig_node] = visited
    return full_lig_graph


def create_full_lig_edges(graph, full_lig_graph):
    node_to_not_adj = {}
    nodes = [node for node in graph]
    for i in range(len(nodes)):
        node1 = nodes[i]
        if node1.tp == "full-ligature":
            continue
       
        # Only consider nodes which are adjacent to segments that are full-ligatures.
        neighbors1 = filter(lambda neighbor: neighbor.tp == "full-ligature", graph[node1])
        if len(neighbors1) == 0:
            continue
        for j in range(len(nodes)):
            if i == j:
                continue
            node2 = nodes[j]
            if node2.tp == "full-ligature":
                continue
            neighbors2 = filter(lambda neighbor: neighbor.tp == "full-ligature", graph[node2])
            if len(neighbors2) == 0:
                continue
            
            # For each pair of neighbors that are of tp full-ligature check if they
            # are connected.
            for neighbor1 in neighbors1:
                if any([neighbor2 in full_lig_graph[neighbor1] for neighbor2 in neighbors2]):
                    graph[node1].append(node2)
                    if srfs_contactpoints(node1.srf, node2.srf, 0.1) < 3:
                        if node1 in node_to_not_adj:
                            node_to_not_adj[node1].append(node2)
                        else:
                            node_to_not_adj[node1] = [node2]
    
    # Now create the missing surfaces.
    closed = len(node_to_not_adj) * [False]  # True if a node was already in a covering event.
    missing_faces = []
    not_adj_nodes = [n for n in node_to_not_adj]
    all_subgroups = []
    not_adj_srfs = []
    for n in node_to_not_adj:
        not_adj_srfs.append([x.srf for x in node_to_not_adj[n]] + [n.srf])
    for node in not_adj_nodes:
        
        if closed[not_adj_nodes.index(node)]:
            continue
        
        # A single node might be adjacent to two missing faces. In this case we
        # need to split up its neighbors into groups.
        sub_groups = []
        neighbors = node_to_not_adj[node]
        while len(neighbors) > 0:
            queue = [neighbors[0]]
            visited = []
            while len(queue) > 0:
                curr_node = queue.pop()
                if curr_node in visited:
                    continue
                visited.append(curr_node)
                for neigh in neighbors:
                    if neigh in visited:
                        continue
                    if neigh in graph[curr_node]:
                        queue.append(neigh)
            sub_groups.append(visited)
            for vis in visited:
                neighbors.remove(vis)
        
        # Now that the subgroups have been found, we find the corners of the enclosed srfs.
        for sub_group in sub_groups:
            shared_corners = srf_shared_corners([n.srf for n in sub_group] + [node.srf])
            if len(shared_corners) < 3:
                print "here"
                continue
            """
            if not are_points_convex(shared_corners, 0.1):
                print "here"
                continue
            """
            all_subgroups.append([n.srf for n in sub_group] + [node.srf])
            new_srf = create_srf_from_points(shared_corners)
            if not new_srf:
                print "Corners lead to faulty surface."
            new_sgmt = None
            new_tp = "semi-ligature"
            new_bp = [-1]
            new_node = Node(new_sgmt, new_srf, new_tp, new_bp)
            
            # Create connection to new node.
            for neigh in sub_group + [node]:
                graph[neigh].append(new_node)
            
            # Create connections from new node to neighbors.
            graph[new_node] = sub_group + [node]
            
            # Mutually disconnect old neighbors.
            for n1 in sub_group + [node]:
                for n2 in sub_group + [node]:
                    while n2 in graph[n1]:
                        graph[n1].remove(n2)
            
            # TODO: don't forget to mark nodes.
            missing_faces.append(new_srf)
            for n in sub_group:
                closed[not_adj_nodes.index(n)] = True
        closed[not_adj_nodes.index(node)] = True
    
    return th.list_to_tree(all_subgroups), th.list_to_tree(not_adj_srfs)


def srf_shared_corners(srfs):
    corners = [srf.DuplicateVertices() for srf in srfs]
    shared_corners = []
    for i in range(len(corners)):
        for j in range(i + 1, len(corners)):
            corners1 = corners[i]
            corners2 = corners[j]
            for I in range(len(corners1)):
                for J in range(len(corners2)):
                    c1 = corners1[I]
                    c2 = corners2[J]
                    if rs.Distance(c1, c2) < 0.1:
                        shared_corners.append(c1)
    return shared_corners


def srfs_contactpoints(srf1, srf2, tol):
    # Checking for overlaps of boundary-curves: Infinitely many contact-points.
    edges1 = srf1.DuplicateEdgeCurves()
    edges2 = srf2.DuplicateEdgeCurves()
    for e1 in edges1:
        for e2 in edges2:
            intersection = rs.CurveCurveIntersection(e1, e2)
            if not intersection:
                continue
            intersection_types = [info[0] for info in intersection]
            if 2 in intersection_types:
                return float("inf")
    
    # Checking for singular points.
    corners1 = srf1.DuplicateVertices()
    corners2 = srf2.DuplicateVertices()
    num_contact_points = 0
    for c1 in corners1:
        for c2 in corners2:
            if rs.Distance(c1, c2) < tol:
                num_contact_points += 1
    return num_contact_points


#------------------------------------------------------------------------------#
# SCRIPT START.                                                                #
#------------------------------------------------------------------------------#
script_start = time.time()

#------------------------------------------------------------------------------#
# Cleaning up inputs: Removing segments which are None (and their srfs, tps).#
#------------------------------------------------------------------------------#
print "Preprocessing inputs."
start = time.time()
medax_sgmts, convex_srfs, tps = input_preprocessing(medax_sgmts, convex_srfs, tps)
end = time.time()
print "Preprocessing inputs took " + str(end - start) + " seconds."

#------------------------------------------------------------------------------#
# Finding adjacency to branchpoints.                                           #
#------------------------------------------------------------------------------#
print "Finding adjacency to branchpoints."
start = time.time()
closest_branchpoint = branchpoint_adjacency(medax_sgmts, branch_points)
end = time.time()
print "Finding adjacency to branchpoints took " + str(end - start) + " seconds."

#------------------------------------------------------------------------------#
# Creating nodes.                                                              #
#------------------------------------------------------------------------------#
print "Creating nodes."
start = time.time()
nodes = [Node(medax_sgmts[i], convex_srfs[i], tps[i], closest_branchpoint[i]) for i in range(len(medax_sgmts))]
end = time.time()
print "Creating " + str(len(nodes)) + " nodes took " + str(end - start) + " seconds."
end = time.time()

#------------------------------------------------------------------------------#
# Removing nodes whose nodes correspond to surfaces that are not on layout.    #
#------------------------------------------------------------------------------#
print "Removing surfaces outside of layout."
start = time.time()
nodes = remove_invalid_srfs(nodes, boundary_crvs, layout_srf)
end = time.time()
print "Removing surfaces outside of layout took " + str(end - start) + " seconds."

#------------------------------------------------------------------------------#
# Creating graph.                                                              #
#------------------------------------------------------------------------------#
print "Creating graph."
start = time.time()
graph = create_graph(nodes)
end = time.time()
print "Creating graph took " + str(end - start) + " seconds."

#------------------------------------------------------------------------------#
# Merging adjacent surfaces of same type.                                      #
#------------------------------------------------------------------------------#
print "Merging adjacent surfaces of same type."
start = time.time()
merge_same_tp_nodes(graph, "normal")
merge_same_tp_nodes(graph, "semi-ligature")
end = time.time()
print "Merging surfaces took " + str(end - start) + " seconds."


#------------------------------------------------------------------------------#
# Merging nodes around ligatures.                                              #
#------------------------------------------------------------------------------#
print "Merging around ligature."
start = time.time()
try:
    merge_around_semi_ligs(graph)
except:
    pass
end = time.time()
print "Merging around ligature took " + str(end - start) + " seconds."

#------------------------------------------------------------------------------#
# Testing connectivity of subgraph consisting only of full ligatures.          #
#------------------------------------------------------------------------------#
print "Testing connectivity of subgraphs constituted by full-ligatures."
start = time.time()
full_lig_graph = create_full_lig_graph(graph)
# print "len(full_lig_graph) " + str(len(full_lig_graph))
print "Testing connectivity took " + str(end - start) + " seconds."

#------------------------------------------------------------------------------#
# Adding edges based on adjacency to full-ligatures.                           #
#------------------------------------------------------------------------------#
print "Adding edges based on adjacency to full-ligatures."
start = time.time()
#all_subgroups, not_adj_srfs = create_full_lig_edges(graph, full_lig_graph)
"""
try:
    merge_around_semi_ligs(graph)
except:
    pass
"""
end = time.time()
print "Adding edges took " + str(end - start) + " seconds."

#------------------------------------------------------------------------------#
# Creating points (nodes) and edges (lines) of the graph.                      #
#------------------------------------------------------------------------------#
print "Visualizing graph."
start = time.time()
old_nodes = nodes
segs = flatten([node.sgmt for node in old_nodes])
nodes, edges = visualize_graph(graph)
neigh_srfs = [[neigh.srf for neigh in graph[node] if neigh.srf] for node in graph if node.srf]
weird = []
for neigh in neigh_srfs:
    unique = []
    for srf in neigh:
        if not any([simple_srf_compare(srf, added) for added in unique]):
            unique.append(srf)
    weird.append(unique)
degrees = [len(neigh) for neigh in weird]
srfs = []
colors = []
for node in graph:
    srfs.append(node.srf)
    r = (0.1 + random.random() * 0.9) * 255
    g = (0.1 + random.random() * 0.9) * 255
    b = (0.1 + random.random() * 0.9) * 255
    colors.append(rs.CreateColor(r, g, b))
end = time.time()
print "Visualizing graph took " + str(end - start) + " seconds."

#------------------------------------------------------------------------------#
# SCRIPT END.                                                                  #
#------------------------------------------------------------------------------#
script_end = time.time()
print "Script ran for " + str(script_end - script_start) + " seconds."
# ---------- end createconvexpartition ----------
splitmedialaxiscurvesatbranchpoints = CSharpScript(medialAxisCurvesList=join_2, branchpointsList=findbranchpoints.branch_points)  # -> out, splitMedialAxisCurvesList; inputs medialAxisCurvesList: list of Curve, branchpointsList: list of Point3d
# ---------- splitmedialaxiscurvesatbranchpoints: C# ----------
    List<Curve> splitAtBranchPoints = new List<Curve>();

    // For each curve, find which branch-points are close.
    // Then split the curve at these branchpoints.
    foreach (Curve curve in medialAxisCurvesList)
    {
      // Find closest points on current for each branchpoint.
      double[] closestParameters = new double[branchpointsList.Count];
      for (int i = 0; i < branchpointsList.Count; i++)
      {
        double param = -1.0;
        curve.ClosestPoint(branchpointsList[i], out param);
        closestParameters[i] = param;
      }
      Point3d[] closestPoints = new Point3d[branchpointsList.Count];
      for (int i = 0; i < branchpointsList.Count; i++)
      {
        closestPoints[i] = curve.PointAt(closestParameters[i]);
      }

      // Only choose points that are sufficiently close (lie on the current curve).
      List<double> splitParameters = new List<double>();
      for (int i = 0; i < branchpointsList.Count; i++)
      {
        if (closestPoints[i].DistanceTo(branchpointsList[i]) <= 0.01)
        {
          splitParameters.Add(closestParameters[i]);
        }
      }

      // We just append the current curve if no branchpoint is close enough.
      if (splitParameters.Count == 0)
      {
        splitAtBranchPoints.Add(curve);
        continue;
      }

      // Split current curve at selected points.
      Curve[] splitCurves = curve.Split(splitParameters);

      // Add new segments to result.
      splitAtBranchPoints.AddRange(splitCurves);
    }
    splitMedialAxisCurvesList = splitAtBranchPoints;
    JoinIllFormedCurves(splitAtBranchPoints, branchpointsList);
# ---------- splitmedialaxiscurvesatbranchpoints: C# additional code ----------
  /// <summary>
  /// Default tolerance when comparing distances.
  /// </summary>
  private const double DIST_TOL = RhinoMath.DefaultDistanceToleranceMillimeters;

  /// <summary>
  /// Constructs curves whose endpoints are branchpoints from potentially ill-formed curves.
  /// </summary>
  /// <remarks>A curve is ill-formed if it is adjacent to only 1 or 0 branchpoints.</remarks>
  /// <param name="inputCurves">All curves, including well formed ones, from the initial splitting step.</param>
  /// <returns></returns>
  private Curve[] JoinIllFormedCurves(List<Curve> inputCurves, List<Point3d> branchPoints)
  {
    // Identify ill-formed curves.
    List<Curve> illFormedCurves = new List<Curve>();
    List<List<Point3d>> allAdjacentBranchPoints = new List<List<Point3d>>();
    FindIllFormedCurves(inputCurves, branchPoints, ref illFormedCurves, ref allAdjacentBranchPoints);

    // Create graph from ill-formed curves.
    IllFormedCurveGraph graph = CreateIllFormedCurveGraph(illFormedCurves, allAdjacentBranchPoints, branchPoints);

    // TODO: Remove after testing.
    Print("Created graph of ill-formed segments with " + graph.GetNumNodes().ToString() + " nodes and " + graph.GetNumEdges().ToString() + " edges.");
    Print(graph.GetNumNodesAtBranchPoint() + " of these nodes are adjacent to a branch-point.");

    return new Curve[1];
  }

  /// <summary>
  /// For a set of curves created from splitting medial axis curves at branchpoints, find curves that are ill-formed. 
  /// A curve is ill-formed if it is not adjacent to exactly 2 branchpoints. 
  /// Such curves have to undergo further merging.
  /// </summary>
  /// <exception>Throws exception if there is a curve in inputCurves that is adjacent to more than 2 branchpoints.</exception>
  /// <param name="inputCurves">The curves resulting from splitting the medial axis curves at branchpoints.</param>
  /// <param name="branchPoints">The branchpoints at which the curves were split.</param>
  /// <param name="illFormedCurves">Array which will hold the ill-formed curves.</param>
  /// <param name="allAdjacentBranchPoints">Element allAdjacentBranchPoints[i] corresponds to illFormedCurves[i]. It holds the branch-points illFormedCurves[i] is adjacent to (either empty list or one element).</param>
  private void FindIllFormedCurves(List<Curve> inputCurves, List<Point3d> branchPoints, ref List<Curve> illFormedCurves, ref List<List<Point3d>> allAdjacentBranchPoints)
  {
    foreach (Curve curve in inputCurves)
    {
      List<Point3d> adjacentBranchPoints = new List<Point3d>();
      Point3d curveStartPoint = curve.PointAtStart;
      Point3d curveEndPoint = curve.PointAtEnd;
      foreach (Point3d branchPoint in branchPoints)
      {
        if (branchPoint.DistanceTo(curveStartPoint) <= DIST_TOL || branchPoint.DistanceTo(curveEndPoint) <= DIST_TOL)
        {
          adjacentBranchPoints.Add(branchPoint);
        }
        if (adjacentBranchPoints.Count == 2)
        {
          break;
        }
      }

      // If this curve is adjacent to two branchpoints, it is a well formed curve and we do not need to process it further.
      if (adjacentBranchPoints.Count == 2)
      {
        continue;
      }

      // Ill-formed segment.
      else if (adjacentBranchPoints.Count < 2)
      {
        illFormedCurves.Add(curve);
        allAdjacentBranchPoints.Add(adjacentBranchPoints);
      }

      // Should not happen.
      else
      {
        throw new Exception("Curve segment was adjacent to " + adjacentBranchPoints.Count.ToString() + " branch points. A medial axis curve should only be adjacent to 0, 1 or 2 branchpoints.");
      }
    }
  }

  /// <summary>
  /// Creates a graph based on the adjacency of the ill-formed curves.
  /// Checks whether two curves share an endpoints that does not belong to the set of branchpoints.
  /// Such an endpoint is exactly a location where the corresponding curves should be merged to form a larger (and possibly complete) medial axis curve,
  /// which is delimited by two branchpoints.
  /// </summary>
  /// <remarks>
  /// Note that it is sufficient to check whether the enpoints agree in this case, since the input curves are ill-formed,
  /// so one of the enpoints guaranteed to be a non-branchpoint (the other point is ignored with a proximity check).
  /// Thus it cannot happen that curves are represented as connected at positions that were correctly split previously.
  /// </remarks>
  /// <param name="illFormedCurves">The set of ill-formed curves.</param>
  /// <param name="allAdjacentBranchPoints">The branchpoints each ill-formed curve is adjacent to.</param>
  /// <param name="branchPoints">The set of branch points of the medial axis.</param>
  /// <returns>The graph capturing the connectivity of the ill-formed curves.</returns>
  private IllFormedCurveGraph CreateIllFormedCurveGraph(List<Curve> illFormedCurves, List<List<Point3d>> allAdjacentBranchPoints, List<Point3d> branchPoints)
  {
    IllFormedCurveGraph graph = new IllFormedCurveGraph();

    // Create all nodes.
    for (int i = 0; i < illFormedCurves.Count; i++)
    {
      try
      {
        graph.AddNode(illFormedCurves[i], allAdjacentBranchPoints[i]);
      }
      catch
      {
        Print("Duplicate curve was attempted to add.");
        continue;
      }
    }

    // Create edges between nodes. Since we want a undirected graph, we have to create both directions of edges.
    for (int i = 0; i < graph.GetNumNodes(); i++)
    {
      for (int j = 0; j < graph.GetNumNodes(); j++)
      {
        // No self-loops.
        if (i == j)
        {
          continue;
        }

        // Create edge.
        Curve curve1 = graph.nodes[i].curve;
        Curve curve2 = graph.nodes[j].curve;
        if (AreCurvesAdjacentAtNonBranchPoint(curve1, curve2, branchPoints))
        {
          graph.AddEdge(curve1, curve2);
        }
      }
    }
    return graph;
  }

  /// <summary>
  /// Checks whether two curves are adjacent at a non-branch-point location.
  /// </summary>
  /// <param name="curve1">The first curve to be checked.</param>
  /// <param name="curve2">The second curve to be checked.</param>
  /// <param name="branchPoints">If the curves are adjacent at a location which is in this list, the adjacency is disregarded.</param>
  /// <returns>true if it is the case, false otherwise.</returns>
  private bool AreCurvesAdjacentAtNonBranchPoint(Curve curve1, Curve curve2, List<Point3d> branchPoints)
  {
    // Test for intersections.
    Rhino.Geometry.Intersect.CurveIntersections intersections = Rhino.Geometry.Intersect.Intersection.CurveCurve(curve1, curve2, RhinoMath.SqrtEpsilon, RhinoMath.SqrtEpsilon);

    // Filter all non-point intersections.
    List<Rhino.Geometry.Intersect.IntersectionEvent> pointIntersections = new List<Rhino.Geometry.Intersect.IntersectionEvent>();
    foreach (Rhino.Geometry.Intersect.IntersectionEvent intersection in intersections)
    {
      if (intersection.IsPoint)
      {
        pointIntersections.Add(intersection);
      }
    }

    // If we only have overlaps (no point-intersections), we return false.
    if (pointIntersections.Count == 0)
    {
      return false;
    }

    // For each point-intersection check if the intersecting point is a branch point.
    foreach (Point3d branchPoint in branchPoints)
    {
      foreach (Rhino.Geometry.Intersect.IntersectionEvent intersection in pointIntersections)
      {
        if (intersection.PointA.DistanceTo(branchPoint) < DIST_TOL)
        {
          return false;
        }
      }
    }
    return true;
  }

  /// <summary>
  /// Models the connectivity of ill-formed segments.
  /// </summary>
  public class IllFormedCurveGraph
  {
    private List<IllFormedCurveNode> _nodes;

    public List<IllFormedCurveNode> nodes
    {
      get
      {
        return _nodes;
      }
    }

    private List<List<IllFormedCurveNode>> _adjacencyList;

    public List<List<IllFormedCurveNode>> adjacencyList
    {
      get
      {
        return _adjacencyList;
      }
    }

    public IllFormedCurveGraph()
    {
      _nodes = new List<IllFormedCurveNode>();
      _adjacencyList = new List<List<IllFormedCurveNode>>();
    }

    /// <summary>
    /// Adds a node to the graph.
    /// </summary>
    /// <exception>Exception will be thrown if (1) the curve is not ill-formed (determined by the number of adjacent branch points) or (2) the node was already added.</exception>
    /// <param name="curve">Curve this node corresponds to.</param>
    /// <param name="branchPoints">List of branchpoints this curve is adjacent to. Since IllFormedNodes only correspond to curves which have only 1 or 0 adjacent branchpoints, length of this list can at most be 1.</param>
    public void AddNode(Curve curve, List<Point3d> branchPoints)
    {

      // Create node.
      IllFormedCurveNode node;
      if (branchPoints.Count == 0)
      {
        node = new IllFormedCurveNode(curve);
      }
      else if (branchPoints.Count == 1)
      {
        node = new IllFormedCurveNode(curve, branchPoints[0]);
      }
      else
      {
        throw new Exception("Attempted to construct IllFormedCurveNode, but branchPoint.Count: " + branchPoints.Count.ToString() + ". This curve is either not ill-formed or there are too many branchpoints.");
      }

      // Check if node is unique.
      if (_nodes.Contains(node))
      {
        throw new Exception("Tried to add node " + node.ToString() + " but node was already added at index " + GetNodeIndex(node.curve) + " in the form " + _nodes[GetNodeIndex(node.curve)] + ".");
      }

      // Add node.
      _nodes.Add(node);
      _adjacencyList.Add(new List<IllFormedCurveNode>());
    }

    /// <summary>
    /// Adds directed edge from node corresponding to curve1 to node corresponding to curve2.
    /// </summary>
    /// <remarks>To model undirected graph, symmetric edge (from node corresponding to curve2 to node corresponding to node1) must be added as well.</remarks>
    /// <exception>Throws exception if (1) either of the nodes are not present in the graph or (2) the edge has already been added or (3) the nodes are equal (self-loop not allowed).</exception>
    /// <param name="curve1">The node corresponding </param>
    /// <param name="curve2"></param>
    public void AddEdge(Curve curve1, Curve curve2)
    {
      // Get indices of nodes.
      int index1 = GetNodeIndex(curve1);
      int index2 = GetNodeIndex(curve2);
      if (index1 == -1 || index2 == -1)
      {
        throw new Exception("Attempted to get nodes when creating edge, but nodes are not in graph.");
      }

      IllFormedCurveNode node1 = _nodes[index1];
      IllFormedCurveNode node2 = _nodes[index2];

      // Check nodes for equality.
      if (node1 == node2)
      {
        throw new Exception("Node corresponding to curve1 and curve2 are equivalent, but self-loops are not allowed.");
      }

      // Check if edge has already been added.
      if (_adjacencyList[index1].Contains(node2))
      {
        throw new Exception("Attempted to add edge, but node " + node2.ToString() + " was already added as neighbor at index " + _adjacencyList[index1].IndexOf(node2) + " in the form " + _adjacencyList[index1][_adjacencyList[index1].IndexOf(node2)] + ".");
      }

      // Add edge.
      _adjacencyList[index1].Add(node2);
    }


    /// <summary>
    /// Gets a node by its curve.
    /// </summary>
    /// <param name="curve">The curve that corresponds to the node.</param>
    /// <exception>Throws exception if node is not in graph.</exception>
    /// <returns>Node if exists.</returns>
    private IllFormedCurveNode GetNode(Curve curve)
    {
      int index = GetNodeIndex(curve);
      if (index == -1)
      {
        throw new Exception("Attempted to get node, but node is not in graph.");
      }
      return _nodes[index];
    }

    /// <summary>
    /// Gets neighbors of node identified by curve.
    /// </summary>
    /// <param name="curve">Curve that corresponds to node.</param>
    /// <exception>Throws exception if node is not in graph.</exception>
    /// <returns>Neighbors if node is found.</returns>
    private List<IllFormedCurveNode> GetNeighbors(Curve curve)
    {
      int index = GetNodeIndex(curve);
      if (index == -1)
      {
        throw new Exception("Attempted to get neighbors of node, but node is not in graph.");
      }
      return adjacencyList[index];
    }

    /// <summary>
    /// Gets the index of a node by curve.
    /// </summary>
    /// <param name="curve">Curve that corresponds to the node.</param>
    /// <returns>The index of the node in the _nodes list if present, otherwise -1.</returns>
    private int GetNodeIndex(Curve curve)
    {
      // Create mock node for comparison.
      IllFormedCurveNode mockNode = new IllFormedCurveNode(curve);

      // Get index.
      return nodes.IndexOf(mockNode);
    }


    /// <summary>
    /// Gets the index of a node.
    /// </summary>
    /// <param name="node"></param>
    /// <returns>The index of the node in the _nodes list if present, otherwise -1.</returns>
    private int GetNodeIndex(IllFormedCurveNode node)
    {
      return GetNodeIndex(node.curve);
    }


    /// <summary>
    /// Creates as many distinct, non-overlapping branchpoint-bounded medial segment from the current nodes as possible.
    /// </summary>
    /// <returns>Array of medial-axis curves from ill-formed curves represented by the currently added nodes and their edges.</returns>
    public Curve[] GetJoinedCurves()
    {
      // Get all nodes that are adjacent to one branchpoint, as these are the starting points for curves that can be joined.
      List<IllFormedCurveNode> adjToBranchPointNodes = new List<IllFormedCurveNode>();
      foreach (IllFormedCurveNode node in _nodes)
      {
        if (node.adjacentToBranchPoint)
        {
          adjToBranchPointNodes.Add(node);
        }
      }

      // Start new run of BFS for each node that is adjacent to a branch node.
      List<Curve> joinedCurves = new List<Curve>();
      foreach (IllFormedCurveNode startNode in adjToBranchPointNodes)
      {
        // List to keep track of the nodes already visited.
        List<IllFormedCurveNode> visited = new List<IllFormedCurveNode>();
        List<IllFormedCurveNode>[] predecessor = new List<IllFormedCurveNode>[_nodes.Count];
        List<IllFormedCurveNode> queue = new List<IllFormedCurveNode>();
        queue.Add(startNode);

        // Run BFS until no more nodes are enqueued.
        while (queue.Count > 0)
        {

          // Pop node from queue.
          IllFormedCurveNode currNode = queue[0];
          queue.RemoveAt(0);

          // Ignore the current node if it has been visited before.
          if (visited.Contains(currNode))
          {
            continue;
          }

          // Remember that this node has been visited.
          visited.Add(currNode);
          List<IllFormedCurveNode> neighbors = GetNeighbors(currNode.curve);

          // Add each neighbor to the queue.
          foreach (IllFormedCurveNode neighbor in neighbors)
          {
            // If this neighbor has already been visited, we can ignore it.
            if (visited.Contains(neighbor))
            {
              continue;
            }

            // Remember the current node as the predecessor.
            predecessor[GetNodeIndex(neighbor)].Add(currNode);

            // Enqueue the neighbor.
            queue.Add(neighbor);
          }
        }

        // After the BFS has been run, we can read out the paths from the predecessor array and try to combine the curves.
      }

      return new Curve[1];
    }

    /// <summary>
    /// Given a list of immediate predecessors per node, this function calculates the leading to each node.
    /// </summary>
    /// <param name="allPredecessors">List of immediate predecessor per node in graph.</param>
    /// <returns>A list of paths per node in the graph.</returns>
    private List<List<IllFormedCurveNode>>[] ReconstructPredecessorPaths(List<IllFormedCurveNode>[] allPredecessors)
    {
      return new List<List<IllFormedCurveNode>>[1];
    }

    private List<List<IllFormedCurveNode>>[] FollowPath(IllFormedCurveNode thisNode, ref List<List<IllFormedCurveNode>>[] paths)
    {
      return new List<List<IllFormedCurveNode>>[1];
    }


    /// <summary>
    /// Gets the number of currently added nodes.
    /// </summary>
    /// <returns>The number of currently added nodes.</returns>
    public int GetNumNodes()
    {
      return _nodes.Count;
    }

    /// <summary>
    /// Gets the number of currently added edges.
    /// </summary>
    /// <remarks>This gives the number of directed edges, if you are modelling an undirected graph, the number needs to be divided by 2.</remarks>
    /// <returns>The number of currently added edges.</returns>
    public int GetNumEdges()
    {
      int numEdges = 0;
      foreach (List<IllFormedCurveNode> neighbors in _adjacencyList)
      {
        numEdges += neighbors.Count;
      }
      return numEdges;
    }

    public int GetNumNodesAtBranchPoint()
    {
      int num = 0;
      for (int i = 0; i < _nodes.Count; i++)
      {
        if (_nodes[i].adjacentToBranchPoint)
        {
          num += 1;
        }
      }
      return num;
    }
  }

  /// <summary>
  /// A node in the graph of ill-formed segments. A node corresponds to an ill-formed segment.
  /// </summary>
  public class IllFormedCurveNode : IEquatable<IllFormedCurveNode>
  {
    private Curve _curve;

    public Curve curve
    {
      get
      {
        return _curve;
      }
    }

    private bool _adjacentToBranchPoint;

    public bool adjacentToBranchPoint
    {
      get
      {
        return _adjacentToBranchPoint;
      }
    }

    private Point3d _branchPoint;

    public Point3d branchPoint
    {
      get
      {
        return _branchPoint;
      }
    }

    /// <summary>
    /// Constructor if curve is not adjacent to branchpoint.
    /// </summary>
    /// <param name="curve">The curve this node corresponds to.</param>
    public IllFormedCurveNode(Curve curve)
    {
      _curve = curve;
      _adjacentToBranchPoint = false;
      _branchPoint = Point3d.Origin;
    }

    /// <summary>
    /// Constructor if curve is adjacent to branchpoint.
    /// </summary>
    /// <param name="curve">The curve this node corresponds to.</param>
    /// <param name="branchPoint">The branchpoint the curve this node represents is adjacent to.</param>
    public IllFormedCurveNode(Curve curve, Point3d branchPoint)
    {
      _curve = curve;
      _adjacentToBranchPoint = true;
      _branchPoint = branchPoint;
    }

    public static bool operator ==(IllFormedCurveNode left, IllFormedCurveNode right)
    {
      return left.Equals(right);
    }

    public static bool operator !=(IllFormedCurveNode left, IllFormedCurveNode right)
    {
      return !left.Equals(right);
    }

    /// <summary>
    /// Tests for equality. IllFormedCurveNode are equal if the end points of their curves are equal (by some tolerance).
    /// </summary>
    /// <remarks>This comparison only works in this very restricted use-case.</remarks>
    /// <param name="other">The other node to compare to.</param>
    /// <returns>true if nodes are </returns>
    public bool Equals(IllFormedCurveNode other)
    {
      // Compare distances between endpoints - if they are smaller than some tolerance, nodes are considered equal.
      Point3d thisStart = _curve.PointAtStart;
      Point3d thisEnd = _curve.PointAtEnd;
      Point3d otherStart = other.curve.PointAtStart;
      Point3d otherEnd = other.curve.PointAtEnd;

      if (thisStart.DistanceTo(otherStart) < RhinoMath.SqrtEpsilon && thisEnd.DistanceTo(otherEnd) < RhinoMath.SqrtEpsilon ||
          thisStart.DistanceTo(otherEnd) < RhinoMath.SqrtEpsilon && thisEnd.DistanceTo(otherStart) < RhinoMath.SqrtEpsilon)
      {
        return true;
      }
      return false;
    }


    /// <summary>
    /// Tests for equality.
    /// </summary>
    /// <param name="otherObject">Object of any type.</param>
    /// <returns>true if objects are equal, false otherwise.</returns>
    public override bool Equals(object otherObject)
    {
      // Converting to IllFormedCurveNode.
      IllFormedCurveNode other = otherObject as IllFormedCurveNode;

      // Null-check covering faulty conversion.
      if (other == null)
      {
        return false;
      }

      // If conversion was successful (the other object is a IllFormedCurveNode), we can simply call the Equals method from this class.
      return this.Equals(other);
    }


    /// <summary>
    /// Override. Probably not a valid override, but will not be used here.
    /// </summary>
    /// <returns>Hashcode.</returns>
    public override int GetHashCode()
    {
      return base.GetHashCode();
    }

    /// <summary>
    /// Overrides to string methods to print the start- and end-points of curve.
    /// </summary>
    /// <returns></returns>
    public override string ToString()
    {
      return "(" + curve.PointAtStart.X.ToString() + ", " + curve.PointAtStart.Y.ToString() + ")";
    }
  }
# ---------- end splitmedialaxiscurvesatbranchpoints ----------
scriptpar_2 = ScriptParasite(Enable=toggle, Folder=panel)

# ---- group: Visualize Medial Axis
filter = StreamFilter(Gate=visualize_medial_axis, Stream1=splitmedialaxiscurvesatbranchpoints.splitMedialAxisCurvesList)
crv_2 = Curve(filter)

# ---- group: Visualize Partitioning
material_12 = CreateMaterial(Diffuse=createconvexpartition.colors, Specular=RGB(255, 255, 255), Emission=RGB(0, 0, 0), Transparency=0, Shine=0)
filter_2 = StreamFilter(Gate=visualize_partitioning, Stream1=createconvexpartition.srfs)
preview_11 = CustomPreview(Geometry=filter_2, Material=material_12)

# ---- group: Visualize Nodes
filter_3 = StreamFilter(Gate=visualize_nodes, Stream1=createconvexpartition.nodes)
dots = DotDisplay(Point=filter_3, Colour=ColourSwatch(SwatchColor=RGB(0, 0, 0)), Size=Slider(0.25, range=0..1))

# ----
closepathtomedialaxis = CSharpScript(
    medialAxisCurveList=splitmedialaxiscurvesatbranchpoints.splitMedialAxisCurvesList,
    nodePoint3dList=createconvexpartition.nodes)  # -> out, connectingCurveList; inputs medialAxisCurveList: list of Curve, nodePoint3dList: list of Point3d
# ---------- closepathtomedialaxis: C# ----------
    List<Curve> result = new List<Curve>();
    foreach (Point3d node in nodePoint3dList)
    {
      Point3d closestPoint = new Point3d();
      double minDist = double.MaxValue;
      double minParam = 0.0;
      Curve minCurve = medialAxisCurveList[0];

      // Find the closest point over all medial axis curves.
      foreach (Curve medialAxisCurve in medialAxisCurveList)
      {
        double closeParam = RhinoMath.SqrtEpsilon;
        medialAxisCurve.ClosestPoint(node, out closeParam);
        Point3d closePoint = medialAxisCurve.PointAt(closeParam);
        double dist = node.DistanceTo(closePoint);
        if (dist < minDist)
        {
          closestPoint = closePoint;
          minDist = dist;
          minParam = closeParam;
          minCurve = medialAxisCurve;
        }
      }

      // We need to split the curve and add the split segment to the list as well.
      Curve[] splitMedialAxisCurves = minCurve.Split(minParam);
      foreach (Curve splitCurve in splitMedialAxisCurves)
      {
        result.Add(splitCurve);
      }

      // Construct connecting curve to closest point.
      result.Add(new LineCurve(node, closestPoint));
    }
    connectingCurveList = result;
# ---------- end closepathtomedialaxis ----------
scriptpar_3 = ScriptParasite(Enable=toggle, Folder=panel)

explode_2 = Explode(Curve=join_2, Recursive=True)  # -> Segments, Vertices
crv_3 = Curve([closepathtomedialaxis.connectingCurveList, explode_2.Segments])

# ---- group: NurseStation_Pantry
shortwalk = ShortestWalk(Curves=flatten(crv_3), WantedPath=createlocationpairings.NurseStation_Pantry)  # -> ShortestWalk, Succession, Direction, Length

# ---- group: PatientRoom_PatientRoom
shortwalk_2 = ShortestWalk(Curves=flatten(crv_3), WantedPath=createlocationpairings.PatientRoom_PatientRoom)  # -> ShortestWalk, Succession, Direction, Length

# ---- group: NurseStation_PatientRoom
shortwalk_3 = ShortestWalk(Curves=flatten(crv_3), WantedPath=createlocationpairings.NurseStation_PatientRoom)  # -> ShortestWalk, Succession, Direction, Length

# ---- group: UtilityRoom_PatientRoom
shortwalk_4 = ShortestWalk(Curves=flatten(crv_3), WantedPath=createlocationpairings.UtilityRoom_PatientRoom)  # -> ShortestWalk, Succession, Direction, Length

# ---- group: NurseStation_UtilityRoom
shortwalk_5 = ShortestWalk(Curves=flatten(crv_3), WantedPath=createlocationpairings.NurseStation_UtilityRoom)  # -> ShortestWalk, Succession, Direction, Length

# ---- group: NurseStation_Elevator
shortwalk_6 = ShortestWalk(Curves=flatten(crv_3), WantedPath=createlocationpairings.NurseStation_Elevator)  # -> ShortestWalk, Succession, Direction, Length

# ---- group: NurseStation_MedicalClinic
shortwalk_7 = ShortestWalk(Curves=flatten(crv_3), WantedPath=createlocationpairings.NurseStation_MedicalClinic)  # -> ShortestWalk, Succession, Direction, Length

# ---- group: PatientRoom_Pantry
shortwalk_8 = ShortestWalk(Curves=flatten(crv_3), WantedPath=createlocationpairings.PatientRoom_Pantry)  # -> ShortestWalk, Succession, Direction, Length

# ---- group: PatientRoom_Elevator
shortwalk_9 = ShortestWalk(Curves=flatten(crv_3), WantedPath=createlocationpairings.PatientRoom_Elevator)  # -> ShortestWalk, Succession, Direction, Length

# ---- group: MedicationRoom_PatientRoom
shortwalk_10 = ShortestWalk(Curves=flatten(crv_3), WantedPath=createlocationpairings.MedicationRoom_PatientRoom)  # -> ShortestWalk, Succession, Direction, Length

# ---- group: UtilityRoom_MedicalClinic
shortwalk_11 = ShortestWalk(Curves=flatten(crv_3), WantedPath=createlocationpairings.UtilityRoom_ElevatorLobby)  # -> ShortestWalk, Succession, Direction, Length

# ---- group: UtilityRoom_Pantry
shortwalk_12 = ShortestWalk(Curves=flatten(crv_3), WantedPath=createlocationpairings.UtilityRoom_MedicalClinic)  # -> ShortestWalk, Succession, Direction, Length

# ---- group: UtilityRoom_JanitorCloset
shortwalk_13 = ShortestWalk(Curves=flatten(crv_3), WantedPath=createlocationpairings.UtilityRoom_Pantry)  # -> ShortestWalk, Succession, Direction, Length

shortwalk_14 = ShortestWalk(Curves=flatten(crv_3), WantedPath=createlocationpairings.UtilityRoom_JanitorCloset)  # -> ShortestWalk, Succession, Direction, Length

# ----
calculateyti = CalculateYTI(
    A_2=p_patient_room_patient_room,
    I_2=shortwalk_2.Length,
    A_3=p_nurse_station_patient_room,
    I_3=shortwalk_3.Length,
    A_4=p_utility_room_patient_room,
    I_4=shortwalk_4.Length,
    A_5=p_nurse_station_utility_room,
    I_5=shortwalk_5.Length,
    A_6=p_nurse_station_elevator,
    I_6=shortwalk_6.Length,
    A_7=p_nurse_station_medical_clinic,
    I_7=shortwalk_7.Length,
    A_8=p_patient_room_pantry,
    I_8=shortwalk_8.Length,
    A_9=p_patient_room_elevator,
    I_9=shortwalk_9.Length,
    A_10=p_medication_room_patient_room,
    I_10=shortwalk_10.Length,
    A_11=p_utility_room_elevator_lobby,
    I_11=shortwalk_11.Length,
    A_12=p_utility_room_medical_clinic,
    I_12=shortwalk_12.Length,
    A_13=p_utility_room_pantry,
    I_13=shortwalk_13.Length,
    A_14=p_utility_room_janitor_closet,
    I_14=shortwalk_14.Length,
    A=p_nurse_station_pantry,
    I=shortwalk.Length)
calculatesci = CalculateSCI(
    C=shortwalk_2.ShortestWalk,
    L=number_slider,
    gpu=toggle_2,
    C_3=shortwalk_3.ShortestWalk,
    L_2=number_slider,
    C_2=layout_curves,
    gpu_2=toggle_2,
    C_4=shortwalk_10.ShortestWalk,
    L_5=patient_room,
    L_3=number_slider,
    B=number_of_beds_per_patient_room,
    gpu_3=toggle_2,
    C_5=shortwalk_7.ShortestWalk,
    L_4=number_slider,
    gpu_4=toggle_2)
nodes = Point(createconvexpartition.nodes)
python_3 = GhPythonScript(nodes=nodes, edges=crv)  # -> out, ICD; inputs nodes: list of Point3d, edges: list of Curve
# ---------- python_3: Python ----------
__author__ = "rapha"
__version__ = "2021.10.08"

import rhinoscriptsyntax as rs

end_points = []

for edge in edges:
    start_point = rs.CurveStartPoint(edge)
    end_point = rs.CurveEndPoint(edge)
    both = [start_point, end_point]
    end_points.append(both)

node_degrees = []

for node in nodes:
    degree = 0
    for end_point in end_points:
        s = end_point[0]
        e = end_point[1]
        if (rs.Distance(node, s) < 0.1 or rs.Distance(node, e) < 0.1):
            degree += 1
    node_degrees.append(degree)

ICD = sum(node_degrees) / len(node_degrees)
# ---------- end python_3 ----------

yale_traffic_index = Number(calculateyti)
sci = Number(calculatesci)
icd = Number(python_3.ICD)

python_4 = GhPythonScript(YTI=yale_traffic_index, SCI=sci, ICD=icd)  # -> out, strings
# ---------- python_4: Python ----------
__author__ = "rapha"
__version__ = "2021.10.08"

import rhinoscriptsyntax as rs

strings = []

strings.append("YTI: " + str(round(YTI, 2)))
strings.append("SCI: " + str(round(SCI, 2)))
strings.append("ICD: " + str(round(ICD, 2)))
# ---------- end python_4 ----------
textdot_10 = DefineTextDot(Text=python_4.strings, Location=pointlist.Positions, Font="Arial", Size=14)
preview_12 = CustomPreview(Geometry=textdot_10, Material=material_11)

# ==== cluster CalculateYTI
I = ClusterInput()
I_2 = ClusterInput()
I_3 = ClusterInput()
I_4 = ClusterInput()
I_5 = ClusterInput()
I_6 = ClusterInput()
I_7 = ClusterInput()
I_8 = ClusterInput()
I_9 = ClusterInput()
I_10 = ClusterInput()
I_11 = ClusterInput()
I_12 = ClusterInput()
I_13 = ClusterInput()
I_14 = ClusterInput()
A = ClusterInput()
A_2 = ClusterInput()
A_3 = ClusterInput()
A_4 = ClusterInput()
A_5 = ClusterInput()
A_6 = ClusterInput()
A_7 = ClusterInput()
A_8 = ClusterInput()
A_9 = ClusterInput()
A_10 = ClusterInput()
A_11 = ClusterInput()
A_12 = ClusterInput()
A_13 = ClusterInput()
A_14 = ClusterInput()
avr = Average(Input=I)
avr_2 = Average(Input=I_2)
avr_3 = Average(Input=I_3)
avr_4 = Average(Input=I_4)
avr_5 = Average(Input=I_5)
avr_6 = Average(Input=I_6)
avr_7 = Average(Input=I_7)
avr_8 = Average(Input=I_8)
avr_9 = Average(Input=I_9)
avr_10 = Average(Input=I_10)
avr_11 = Average(Input=I_11)
avr_12 = Average(Input=I_12)
avr_13 = Average(Input=I_13)
avr_14 = Average(Input=I_14)
multiplication = Multiplication(A=A, B=avr)
multiplication_2 = Multiplication(A=A_2, B=avr_2)
multiplication_3 = Multiplication(A=A_3, B=avr_3)
multiplication_4 = Multiplication(A=A_4, B=avr_4)
multiplication_5 = Multiplication(A=A_5, B=avr_5)
multiplication_6 = Multiplication(A=A_6, B=avr_6)
multiplication_7 = Multiplication(A=A_7, B=avr_7)
multiplication_8 = Multiplication(A=A_8, B=avr_8)
multiplication_9 = Multiplication(A=A_9, B=avr_9)
multiplication_10 = Multiplication(A=A_10, B=avr_10)
multiplication_11 = Multiplication(A=A_11, B=avr_11)
multiplication_12 = Multiplication(A=A_12, B=avr_12)
multiplication_13 = Multiplication(A=A_13, B=avr_13)
multiplication_14 = Multiplication(A=A_14, B=avr_14)
num = Number(100)
ma = MassAddition(Input=[multiplication_4, multiplication_3, multiplication_5, multiplication_6, multiplication_2, multiplication_7, multiplication_8, multiplication_9, multiplication_10, multiplication_11, multiplication_12, multiplication_13, multiplication_14, multiplication])  # -> Result, PartialResults
division = Division(A=ma.Result, B=num)
R = ClusterOutput(division)

# ==== cluster CalculateSCI
C = ClusterInput()
L = ClusterInput()
gpu = ClusterInput()
C_2 = ClusterInput()
C_3 = ClusterInput()
L_2 = ClusterInput()
gpu_2 = ClusterInput()
C_4 = ClusterInput()
L_3 = ClusterInput()
gpu_3 = ClusterInput()
C_5 = ClusterInput()
L_4 = ClusterInput()
gpu_4 = ClusterInput()
B = ClusterInput()
L_5 = ClusterInput()
explode = Explode(Curve=C_2, Recursive=True)  # -> Segments, Vertices
divlength = DivideLength(Curve=C_4, Length=L_3)  # -> flatten(Points), Tangents, Parameters
divlength_2 = DivideLength(Curve=C_3, Length=L_2)  # -> flatten(Points), Tangents, Parameters
divlength_3 = DivideLength(Curve=C_5, Length=L_4)  # -> flatten(Points), Tangents, Parameters
divlength_4 = DivideLength(Curve=C, Length=L)  # -> flatten(Points), Tangents, Parameters
isovist = Isovist(
    VantagePointS=divlength_4.Points,
    ObstacleLines=flatten(explode.Segments),
    ViewingDirection=Vector(0, 1, 0),
    ViewingRange=1000,
    ViewingAngle=360,
    Precision=360,
    ShowPolygon=True,
    ShowRadials=False,
    UseGPU=gpu)  # -> IsovistPolygon, Radials, ObstacleVisibility, IsovistProperties
isovist_2 = Isovist(
    VantagePointS=divlength_2.Points,
    ObstacleLines=flatten(explode.Segments),
    ViewingDirection=Vector(0, 1, 0),
    ViewingRange=1000,
    ViewingAngle=360,
    Precision=360,
    ShowPolygon=True,
    ShowRadials=False,
    UseGPU=gpu_2)  # -> IsovistPolygon, Radials, ObstacleVisibility, IsovistProperties
isovist_3 = Isovist(
    VantagePointS=divlength.Points,
    ObstacleLines=flatten(explode.Segments),
    ViewingDirection=Vector(0, 1, 0),
    ViewingRange=1000,
    ViewingAngle=360,
    Precision=360,
    ShowPolygon=True,
    ShowRadials=False,
    UseGPU=gpu_3)  # -> IsovistPolygon, Radials, ObstacleVisibility, IsovistProperties
isovist_4 = Isovist(
    VantagePointS=divlength_3.Points,
    ObstacleLines=flatten(explode.Segments),
    ViewingDirection=Vector(0, 1, 0),
    ViewingRange=1000,
    ViewingAngle=360,
    Precision=360,
    ShowPolygon=True,
    ShowRadials=False,
    UseGPU=gpu_4)  # -> IsovistPolygon, Radials, ObstacleVisibility, IsovistProperties
measureindex = Integer(0)
averageisovistmeasure = GhPythonScript(measuresPerPointTree=isovist.IsovistProperties, whichMeasure=measureindex)  # -> out, average; inputs measuresPerPointTree: tree
# ---------- averageisovistmeasure: Python ----------
__author__ = "rapha"
__version__ = "2021.10.08"

import rhinoscriptsyntax as rs
import ghpythonlib.treehelpers as th

measuresPerPoint = []
for i in range(measuresPerPointTree.BranchCount):
    measuresPerPoint.append(measuresPerPointTree.Branch(i))
selectedMeasures = [perPoint[whichMeasure] for perPoint in measuresPerPoint]
print selectedMeasures[:100]
average = sum(selectedMeasures) / len(selectedMeasures)
# ---------- end averageisovistmeasure ----------
averageisovistmeasure_2 = GhPythonScript(measuresPerPointTree=isovist_2.IsovistProperties, whichMeasure=measureindex)  # -> out, average; inputs measuresPerPointTree: tree; same code as averageisovistmeasure
averageisovistmeasure_3 = GhPythonScript(measuresPerPointTree=isovist_3.IsovistProperties, whichMeasure=measureindex)  # -> out, average; inputs measuresPerPointTree: tree; same code as averageisovistmeasure
averageisovistmeasure_4 = GhPythonScript(measuresPerPointTree=isovist_4.IsovistProperties, whichMeasure=measureindex)  # -> out, average; inputs measuresPerPointTree: tree; same code as averageisovistmeasure

# ---- group: SCI: Probabilities of choosing a path
p_patientroom_patientroom = Number(37)
p_patientroom_nursestation = Number(29)
p_patientroom_medicationroom = Number(17)
p_nursestation_medicalclinic = Number(5)

# ----
multiplication = Multiplication(A=averageisovistmeasure.average, B=p_patientroom_patientroom)
multiplication_2 = Multiplication(A=averageisovistmeasure_2.average, B=p_patientroom_nursestation)
multiplication_3 = Multiplication(A=averageisovistmeasure_3.average, B=p_patientroom_medicationroom)
multiplication_4 = Multiplication(A=averageisovistmeasure_4.average, B=p_nursestation_medicalclinic)
ma = MassAddition(Input=[multiplication, multiplication_2, multiplication_3, multiplication_4])  # -> Result, PartialResults
lng = ListLength(List=L_5)
multiplication_5 = Multiplication(A=lng, B=B)
division = Division(A=ma.Result, B=multiplication_5)
R = ClusterOutput(division)
